# Grasshopper definition 0731_TopologyByCenterline_LPA.gh (Grasshopper 1.0.8)
# plug-ins: RhinoCodePluginGH, CORE.Toolbox.Grasshopper, Heteroptera, RhinoInside.Revit.GH, TopologicGH, Human

# ----
# Get Centerline of Walls
built_in_categories = BuiltInCategories("autodesk.revit.category.local:walls-1.0.0", SearchPattern="Wall")
category_filter = CategoryFilter(Categories=built_in_categories, Inverted=False)
query_elements = QueryElements(Filter=category_filter)  # -> Elements, Count
curve = Curve(query_elements.Elements)
element_geometry = ElementGeometry(Elements=query_elements.Elements, DetailLevel=3)  # -> flatten(Geometry); disabled
curve_curve = CurveCurve(CurveA=curve, CurveB=curve)  # -> Points, ParamsA, ParamsB
brep = Brep(element_geometry)  # disabled
custom_preview_lineweights = CustomPreviewLineweights(Geometry=curve, Shader=ColourSwatch(SwatchColor=RGB(255, 90, 120)), Thickness="5", Absolute=False)
clean_duplicate_points = CleanDuplicatePoints(Points=flatten(curve_curve.Points), Tolerance=0.01)  # -> Points, Indices, Status

# ----
# Get Edge Vertexes of Room bottoms
built_in_categories_2 = BuiltInCategories("autodesk.revit.category.local:rooms-1.0.0", SearchPattern="roo")
category_filter_2 = CategoryFilter(Categories=built_in_categories_2, Inverted=False)
query_elements_2 = QueryElements(Filter=category_filter_2)  # -> Elements, Count
spatial_element_geometry = SpatialElementGeometry(SpatialElement=query_elements_2.Elements, BoundaryLocation=0)  # -> Geometry, TopFaces, SideFaces, BottomFaces
deconstruct_brep = DeconstructBrep(Brep=spatial_element_geometry.Geometry)  # -> Faces, Edges, Vertices
deconstruct = Deconstruct(Point=deconstruct_brep.Vertices)  # -> XComponent, YComponent, ZComponent
min_max = MinMax(Number=flatten(deconstruct.ZComponent))  # -> Minimum, Maximum
equality = Equality(FirstNumber=deconstruct.ZComponent, SecondNumber=min_max.Minimum)  # -> Equality, Inequality
cull_pattern = CullPattern(List=deconstruct_brep.Vertices, CullPattern=equality.Equality)

# ----
# Get Centerline of Walls
separation_lines = SeparationLines({"Rooms": -2000066, "Space": -2000831, "Areas": -2000079}, selected="Rooms")
category_filter_3 = CategoryFilter(Categories=separation_lines, Inverted=False)
query_elements_3 = QueryElements(Filter=category_filter_3, Limit=100)  # -> Elements, Count
curve_2 = Curve(query_elements_3.Elements)

built_in_categories_3 = BuiltInCategories("autodesk.revit.category.family:doors-1.0.0", LayoutLevel=2, SearchPattern="Door")

# ----
# For Hus28
# Rooms
built_in_categories_4 = BuiltInCategories("autodesk.revit.category.local:rooms-1.0.0", SearchPattern="roo")  # disabled
category_filter_4 = CategoryFilter(Categories=built_in_categories_4, Inverted=False)  # disabled
query_elements_4 = QueryElements(Filter=category_filter_4)  # -> flatten(Elements), Count; disabled
spatial_element_identity = SpatialElementIdentity(SpatialElement=query_elements_4.Elements)  # -> Location, Placed, Number, Name, Level; disabled

# ----
# Doors
categories = BuiltInCategories("autodesk.revit.category.family:doors-1.0.0", LayoutLevel=2, SearchPattern="Door")  # disabled
catfltr = CategoryFilter(Categories=categories, Inverted=False)  # disabled
query_elements_5 = QueryElements(Filter=catfltr, Limit=100)  # -> Elements, Count; disabled
component_neighbours = ComponentNeighbours(Component=query_elements_5.Elements)  # -> FromRoom, ToRoom, Room, Space; disabled
element_name = ElementName(Element=component_neighbours.FromRoom)  # -> Element, Name; disabled
element_name_2 = ElementName(Element=component_neighbours.ToRoom)  # -> Element, Name; disabled
element_name_3 = ElementName(Element=component_neighbours.Room)  # -> Element, Name; disabled
panel = Panel(element_name_3.Name)  # disabled
panel_2 = Panel(element_name.Name)  # disabled
panel_3 = Panel(element_name_2.Name)  # disabled
panel_4 = Panel("iaac_Door_ToRoom")  # disabled
panel_5 = Panel("iaac_Door_FromRoom")  # disabled
text = Text(element_name_2.Name)  # disabled
text_2 = Text(element_name.Name)  # disabled
element_parameter = ElementParameter(Element=query_elements_5.Elements, Parameter=panel_5, Value=text_2)  # -> Element, Value; disabled
element_parameter_2 = ElementParameter(Element=query_elements_5.Elements, Parameter=panel_4, Value=text)  # -> Element, Value; disabled

categories_2 = BuiltInCategories("autodesk.revit.category.family:doors-1.0.0", LayoutLevel=2, SearchPattern="Door")  # disabled
point_on_curve = PointOnCurve(curve_2, parameter=0.5)
catfltr_2 = CategoryFilter(Categories=built_in_categories_3, Inverted=False)
query_elements_6 = QueryElements(Filter=catfltr_2, Limit=100)  # -> Elements, Count

categories_3 = BuiltInCategories("autodesk.revit.category.family:doors-1.0.0", LayoutLevel=2, SearchPattern="Door")  # disabled
category_filter_5 = CategoryFilter(Categories=categories_3, Inverted=False)  # disabled
query_elements_7 = QueryElements(Filter=category_filter_5, Limit=100)  # -> Elements, Count; disabled
element_geometry_2 = ElementGeometry(Elements=query_elements_7.Elements, DetailLevel=3)  # disabled
bounding_box = BoundingBox(Content=element_geometry_2, Plane=PlaneXY(0, 0, 0), UnionBox=True)  # -> Box, Box_2; disabled
deconstruct_brep_2 = DeconstructBrep(Brep=bounding_box.Box)  # -> Faces, Edges, Vertices; disabled
area = Area(Geometry=deconstruct_brep_2.Faces)  # -> Area, Centroid; disabled
sort_list = SortList(Keys=area.Area, ValuesValuesA=deconstruct_brep_2.Faces)  # -> Keys, ValuesValuesA; disabled
panel_6 = Panel("""0
1""")  # disabled
panel_7 = Panel("""4
5""")  # disabled
panel_8 = Panel("""2
3""")  # disabled
list_item = ListItem(List=sort_list.ValuesValuesA, Index=panel_6, Wrap=True)  # disabled
list_item_2 = ListItem(List=sort_list.ValuesValuesA, Index=panel_7, Wrap=True)  # disabled
list_item_3 = ListItem(List=sort_list.ValuesValuesA, Index=panel_8, Wrap=True)  # disabled
discontinuity = Discontinuity(Curve=list_item_2, Level=1)  # -> Points, Parameters; disabled
discontinuity_2 = Discontinuity(Curve=list_item, Level=1)  # -> Points, Parameters; disabled
discontinuity_3 = Discontinuity(Curve=list_item_3, Level=1)  # -> Points, Parameters; disabled
average = Average(Input=discontinuity.Points)  # disabled
average_2 = Average(Input=discontinuity_2.Points)  # disabled
average_3 = Average(Input=discontinuity_3.Points)  # disabled
shift_paths = ShiftPaths(Data=average, Offset=-1)  # disabled
shift_paths_2 = ShiftPaths(Data=average_2, Offset=-1)  # disabled
shift_paths_3 = ShiftPaths(Data=average_3, Offset=-1)  # disabled
list_item_4 = ListItem(List=simplify(shift_paths), Index=graft(panel_7), Wrap=True)  # -> Item, Item1; disabled
list_item_5 = ListItem(List=simplify(shift_paths_2), Index=graft(panel_6), Wrap=True)  # -> Item, Item1; disabled
list_item_6 = ListItem(List=simplify(shift_paths_3), Index=graft(panel_8), Wrap=True)  # -> Item, Item1; disabled
number_slider = Slider(352, range=0..1000)  # disabled
number_slider_2 = Slider(300, range=0..1000)  # disabled
number_slider_3 = Slider(99, range=0..1000)  # disabled
line = Line(StartPoint=list_item_4.Item, EndPoint=list_item_4.Item1)  # disabled
line_2 = Line(StartPoint=list_item_5.Item, EndPoint=list_item_5.Item1)  # disabled
line_3 = Line(StartPoint=list_item_6.Item, EndPoint=list_item_6.Item1)  # disabled
extend_curve = ExtendCurve(Curve=line, Type=0, Start=number_slider, End=number_slider)  # disabled
extend_curve_2 = ExtendCurve(Curve=line_2, Type=0, Start=number_slider_2, End=number_slider_2)  # disabled
extend_curve_3 = ExtendCurve(Curve=line_3, Type=0, Start=number_slider_3, End=number_slider_3)  # disabled
merge = Merge(Data1=extend_curve, Data2=extend_curve_2, Data3=extend_curve_3)  # disabled
bounding_box_2 = BoundingBox(Content=merge, Plane=PlaneXY(0, 0, 0), UnionBox=True)  # -> Box, Box_2; disabled

panel_9 = Panel("Level")  # disabled
category_filter_6 = CategoryFilter(Categories=categories_2, Inverted=False)  # disabled
wall_system_family = WallSystemFamily({"Basic": 0, "Curtain": 1, "Stacked": 2}, selected="Basic")  # disabled

wall_system_family_2 = WallSystemFamily({"Basic": 0, "Curtain": 1, "Stacked": 2}, selected="Basic")  # disabled
query_walls = QueryWalls(WallSystemFamily=wall_system_family_2)  # disabled
element_geometry_3 = ElementGeometry(Elements=query_walls, DetailLevel=3)  # disabled
deconstruct_brep_3 = DeconstructBrep(Brep=element_geometry_3)  # -> Faces, Edges, Vertices; disabled
brep_2 = Brep(flatten(deconstruct_brep_3.Faces))  # disabled

levels_picker = LevelsPicker(<levels picker referenced from the Revit model>)  # disabled
query_elements_8 = QueryElements(Filter=category_filter_6, Limit=100)  # -> Elements, Count; disabled
element_parameter_3 = ElementParameter(Element=query_elements_8.Elements, Parameter=panel_9)  # -> Element, Value; disabled

# ----
# Get some Properties
panel_10 = Panel("Type")
element_parameter_4 = ElementParameter(Element=query_elements_6.Elements, Parameter=panel_10)  # -> Element, Value
text_split = TextSplit(Text=element_parameter_4.Value, Separators=":")
list_item_7 = ListItem(List=text_split, Index=0, Wrap=True)  # -> Item, Item1, Item2, Item3
text_trim = TextTrim(Text=list_item_7.Item1, Start=True, End=True)  # -> flatten(Result)
text_trim_2 = TextTrim(Text=list_item_7.Item2, Start=True, End=True)  # -> flatten(Result)

query_walls_2 = QueryWalls(WallSystemFamily=wall_system_family)  # disabled
level = Level(levels_picker)  # disabled
element_geometry_4 = ElementGeometry(Elements=query_walls_2, DetailLevel=3)  # disabled
levels_picker_2 = LevelsPicker(<levels picker referenced from the Revit model>)  # disabled
match_text = MatchText(Text=element_parameter_3.Value, Pattern=levels_picker_2, Case=True)  # disabled
deconstruct_brep_4 = DeconstructBrep(Brep=element_geometry_4)  # -> Faces, Edges, Vertices; disabled
panel_11 = Panel("Elevation")  # disabled
brep_3 = Brep(flatten(deconstruct_brep_4.Faces))  # disabled
level_2 = Level(levels_picker_2)  # disabled
element_parameter_5 = ElementParameter(Element=level, Parameter=panel_11)  # -> Element, Value; disabled
cull_pattern_2 = CullPattern(List=query_elements_8.Elements, CullPattern=match_text)  # disabled
element_geometry_5 = ElementGeometry(Elements=cull_pattern_2, DetailLevel=3)  # disabled
bounding_box_3 = BoundingBox(Content=element_geometry_5, Plane=PlaneXY(0, 0, 0), UnionBox=True)  # -> Box, Box_2; disabled
deconstruct_brep_5 = DeconstructBrep(Brep=bounding_box_3.Box)  # -> Faces, Edges, Vertices; disabled
entwine = Entwine(Branch00=curve_2, Branch01=curve, FlattenInputs=True)
construct_point = ConstructPoint(XCoordinate=0, YCoordinate=0, ZCoordinate=element_parameter_5.Value)  # disabled
area_2 = Area(Geometry=deconstruct_brep_5.Faces)  # -> Area, Centroid; disabled

# ----
# Pull Edge Vertices to Centerline
pull_point = PullPoint(Point=cull_pattern, Geometry=clean_duplicate_points.Points, ClosestOnly=True)  # -> ClosestPoint, Distance

match_text_2 = MatchText(Text=spatial_element_identity.Level, Pattern=levels_picker_2, Case=True)  # disabled
cull_pattern_3 = CullPattern(List=query_elements_4.Elements, CullPattern=match_text_2)  # disabled
xy_plane = XYPlane(Origin=construct_point)  # disabled
sort_list_2 = SortList(Keys=area_2.Area, ValuesValuesA=deconstruct_brep_5.Faces)  # -> Keys, ValuesValuesA; disabled

# ----
# Room Separation Line as "wall"
panel_12 = Panel("2800")
unit_z = UnitZ(Factor=panel_12)
curve_3 = Curve(curve_2)
extrude = Extrude(Base=curve_3, Direction=unit_z)
surface = Surface(extrude)

panel_13 = Panel("Elevation")  # disabled
merge_2 = Merge(Data1="aperture", Data2=text_trim_2)
merge_3 = Merge(Data1="aperture", Data2=text_trim)
element_parameter_6 = ElementParameter(Element=level_2, Parameter=panel_13)  # -> Element, Value; disabled
panel_14 = Panel("""0
1""")  # disabled
panel_15 = Panel("""4
5""")  # disabled
panel_16 = Panel("""2
3""")  # disabled
list_item_8 = ListItem(List=sort_list_2.ValuesValuesA, Index=panel_14, Wrap=True)  # disabled
list_item_9 = ListItem(List=sort_list_2.ValuesValuesA, Index=panel_15, Wrap=True)  # disabled
list_item_10 = ListItem(List=sort_list_2.ValuesValuesA, Index=panel_16, Wrap=True)  # disabled

# ----
# Generate Bottom Faces of Rooms
deconstruct_2 = Deconstruct(Point=pull_point.ClosestPoint)  # -> XComponent, YComponent, ZComponent
python_3_script = Python3Script(x=deconstruct_2.XComponent, y=deconstruct_2.YComponent, z=deconstruct_2.ZComponent)  # -> out, RoomBottomFace; inputs x: tree of Double, y: tree of Double, z: tree of Double
# ---------- python_3_script: Python ----------
import topologicpy

def data_tree_to_nested_list(data_tree, base_retrieval=lambda x: x[0]):
    """
    Converts a Grasshopper DataTree into a nested list structure.
    """
    def extend_list(path, depth, simple_data, nested_list):
        target_index = path[depth]
        if len(nested_list) <= target_index:
            nested_list.extend([None] * (target_index - len(nested_list) + 1))
        
        if depth == path.Length - 1:
            nested_list[target_index] = list(simple_data)
        else:
            if nested_list[target_index] is None:
                nested_list[target_index] = []
            extend_list(path, depth + 1, simple_data, nested_list[target_index])

    nested_structure = []
    for i in range(data_tree.BranchCount):
        branch_path = data_tree.Path(i)
        extend_list(branch_path, 0, data_tree.Branch(branch_path), nested_structure)
    
    return base_retrieval(nested_structure)

# Convert the Grasshopper DataTrees to nested lists
x_coords = data_tree_to_nested_list(x)
y_coords = data_tree_to_nested_list(y)
z_coords = data_tree_to_nested_list(z)

# Determine the number of rooms
total_rooms = len(x_coords[0])
print(f"Total Rooms to Generate: {total_rooms}")

# List to store generated rooms
VerticesOfRooms = []
RoomBottomFace = []

# Iterate over the coordinate sets for each room
for room_index, (x_set, y_set, z_set) in enumerate(zip(x_coords[0], y_coords[0], z_coords[0]), start=1):
    print(f"Start Generation Room {room_index} / {total_rooms}")
    room_vertices = []
    for x, y, z in zip(x_set, y_set, z_set):
        # Create a vertex from coordinates
        vertex = topologicpy.Vertex.Vertex.ByCoordinates(x, y, z)
        room_vertices.append(vertex)
    
    # Add vertices to the list
    VerticesOfRooms.append(room_vertices)
    
    # Create a face from the vertices
    face = topologicpy.Face.Face.ByVertices(room_vertices)
    RoomBottomFace.append(face)

# Output the generated faces
print("Generated Bottom Faces of Rooms:", RoomBottomFace)
# ---------- end python_3_script ----------

construct_point_2 = ConstructPoint(XCoordinate=0, YCoordinate=0, ZCoordinate=element_parameter_6.Value)  # disabled
discontinuity_4 = Discontinuity(Curve=list_item_9, Level=1)  # -> Points, Parameters; disabled
discontinuity_5 = Discontinuity(Curve=list_item_8, Level=1)  # -> Points, Parameters; disabled
discontinuity_6 = Discontinuity(Curve=list_item_10, Level=1)  # -> Points, Parameters; disabled
xy_plane_2 = XYPlane(Origin=construct_point_2)  # disabled
average_4 = Average(Input=discontinuity_4.Points)  # disabled
average_5 = Average(Input=discontinuity_5.Points)  # disabled
average_6 = Average(Input=discontinuity_6.Points)  # disabled
unit_z_2 = UnitZ(Factor=1)
shift_paths_4 = ShiftPaths(Data=average_4, Offset=-1)  # disabled
shift_paths_5 = ShiftPaths(Data=average_5, Offset=-1)  # disabled
shift_paths_6 = ShiftPaths(Data=average_6, Offset=-1)  # disabled
panel_17 = Panel(python_3_script.out)
spatial_element_geometry_2 = SpatialElementGeometry(SpatialElement=simplify(flatten(cull_pattern_3)), BoundaryLocation=0)  # -> Geometry, TopFaces, SideFaces, BottomFaces; disabled
list_item_11 = ListItem(List=simplify(shift_paths_4), Index=graft(panel_15), Wrap=True)  # -> Item, Item1; disabled
list_item_12 = ListItem(List=simplify(shift_paths_5), Index=graft(panel_14), Wrap=True)  # -> Item, Item1; disabled
list_item_13 = ListItem(List=simplify(shift_paths_6), Index=graft(panel_16), Wrap=True)  # -> Item, Item1; disabled
number_slider_4 = Slider(352, range=0..1000)  # disabled
number_slider_5 = Slider(300, range=0..1000)  # disabled
number_slider_6 = Slider(99, range=0..1000)  # disabled
line_4 = Line(StartPoint=list_item_11.Item, EndPoint=list_item_11.Item1)  # disabled
line_5 = Line(StartPoint=list_item_12.Item, EndPoint=list_item_12.Item1)  # disabled
line_6 = Line(StartPoint=list_item_13.Item, EndPoint=list_item_13.Item1)  # disabled
extend_curve_4 = ExtendCurve(Curve=line_4, Type=0, Start=number_slider_4, End=number_slider_4)  # disabled
extend_curve_5 = ExtendCurve(Curve=line_5, Type=0, Start=number_slider_5, End=number_slider_5)  # disabled

# ----
# Extrude Upwards
# >> Room Cells
panel_18 = Panel("5")
python_3_script_2 = Python3Script(RoomBottomFace=python_3_script.RoomBottomFace, Heigth=panel_18)  # -> out, CellsRooms; inputs RoomBottomFace: list, Heigth: Double
# ---------- python_3_script_2: Python ----------
import topologicpy

CellsRooms = []

for Face in RoomBottomFace:
    CellRoom = topologicpy.Cell.Cell.ByThickenedFace(face = Face, thickness = Heigth, bothSides = False, reverse = True)
    CellsRooms.append(CellRoom)
# ---------- end python_3_script_2 ----------

extend_curve_6 = ExtendCurve(Curve=line_6, Type=0, Start=number_slider_6, End=number_slider_6)  # disabled
brep_4 = Brep(spatial_element_geometry_2.Geometry)  # disabled

# ----
# Convert to Cell Complex
python_3_script_3 = Python3Script(Cells=python_3_script_2.CellsRooms)  # -> out, CellComplex; inputs Cells: list
# ---------- python_3_script_3: Python ----------
import topologicpy

CellComplex = topologicpy.CellComplex.CellComplex.ByCells(Cells)
# ---------- end python_3_script_3 ----------

python_3_script_4 = Python3Script(topology=python_3_script_3.CellComplex)  # -> out, geometry; disabled
# ---------- python_3_script_4: Python ----------
from topologicpy.Topology import Topology
import Rhino.Geometry as rg

topology = Topology.Triangulate(topology)
d = Topology.Geometry(topology)

def create_mesh(vertices, edges, faces):
    # Create an empty mesh
    mesh = rg.Mesh()

    # Add vertices to the Mesh
    for vertex in vertices:
        mesh.Vertices.Add(vertex)

    # Add faces to the Brep
    for face in faces:
        mesh.Faces.AddFace(face[0], face[1], face[2])

    mesh.UnifyNormals()
    return mesh

verts = d["vertices"]
edges = d["edges"]
faces = d["faces"]

vertices = [rg.Point3d(v[0],v[1],v[2]) for v in verts]

# create the mesh
geometry = create_mesh(vertices, edges, faces)
# ---------- end python_3_script_4 ----------
path_mapper = PathMapper(source="{A;B}", target="{0;A;B}")
python_3_script_5 = Python3Script(topology=python_3_script_3.CellComplex)  # -> out, geometry; same code as python_3_script_4
merge_4 = Merge(Data1=extend_curve_4, Data2=extend_curve_5, Data3=extend_curve_6)  # disabled
bounding_box_4 = BoundingBox(Content=merge_4, Plane=PlaneXY(0, 0, 0), UnionBox=True)  # -> Box, Box_2; disabled
shape_in_brep = ShapeInBrep(Brep=bounding_box_4.Box, Shape=brep_3)  # disabled
shape_in_brep_2 = ShapeInBrep(Brep=bounding_box_2.Box, Shape=brep_2)  # disabled

# ---- group: Rooms with stairs
categories_4 = BuiltInCategories("autodesk.revit.category.local:stairs-1.0.0", LayoutLevel=2, SearchPattern="Stairs")  # disabled
catfltr_3 = CategoryFilter(Categories=categories_4, Inverted=False)  # disabled
query_elements_9 = QueryElements(Filter=catfltr_3, Limit=100)  # -> Elements, Count; disabled
bounding_box_5 = BoundingBox(Content=query_elements_9.Elements, Plane=PlaneXY(0, 0, 0))  # -> Box, Box_2; disabled
volume = Volume(Geometry=bounding_box_5.Box)  # -> Volume, Centroid; disabled
point_in_brep = PointInBrep(Brep=simplify(brep_4), Point=simplify(graft(volume.Centroid)), Strict=False)  # disabled
python_3_script_6 = Python3Script(x=point_in_brep)  # -> out, a; inputs x: tree of Boolean; disabled
# ---------- python_3_script_6: Python ----------
import ghpythonlib.treehelpers as th

x_list=th.tree_to_list(x, retrieve_base=lambda x: x)

a = []

for i, branch in enumerate(x_list):
    print(f"- Branch: {str(i)} -")

    for j, item in enumerate(branch):
        if i == 0:
            a.append(item)
        else:
            if item == True:
                a[j] = True
# ---------- end python_3_script_6 ----------
cull_pattern_4 = CullPattern(List=brep_4, CullPattern=python_3_script_6.a)  # disabled

# ----
inside = Panel("0")  # disabled
inside_2 = Panel("0")  # disabled
equality_2 = Equality(FirstNumber=shape_in_brep, SecondNumber=inside)  # -> Equality, Inequality; disabled
equality_3 = Equality(FirstNumber=shape_in_brep_2, SecondNumber=inside_2)  # -> Equality, Inequality; disabled
deconstruct_brep_6 = DeconstructBrep(Brep=brep_4)  # -> Faces, Edges, Vertices; disabled
cull_pattern_5 = CullPattern(List=brep_3, CullPattern=equality_2.Equality)  # disabled
cull_pattern_6 = CullPattern(List=brep_2, CullPattern=equality_3.Equality)  # disabled
point = Point(deconstruct_brep_6.Vertices)  # disabled
area_3 = Area(Geometry=cull_pattern_5)  # -> Area, Centroid; disabled
area_4 = Area(Geometry=cull_pattern_6)  # -> Area, Centroid; disabled
deconstruct_3 = Deconstruct(Point=deconstruct_brep_6.Vertices)  # -> XComponent, YComponent, ZComponent; disabled
deconstruct_4 = Deconstruct(Point=point)  # -> XComponent, YComponent, ZComponent; disabled
deconstruct_5 = Deconstruct(Point=area_3.Centroid)  # -> XComponent, YComponent, ZComponent; disabled
deconstruct_6 = Deconstruct(Point=area_4.Centroid)  # -> XComponent, YComponent, ZComponent; disabled
min_max_2 = MinMax(Number=deconstruct_4.ZComponent)  # -> Minimum, Maximum; disabled
number_slider_7 = Slider(27, range=0..100)  # disabled
number_slider_8 = Slider(28, range=0..100)  # disabled
number_slider_9 = Slider(26, range=0..100)  # disabled
python_3_script_7 = Python3Script(x=deconstruct_3.XComponent, y=deconstruct_3.YComponent, z=deconstruct_3.ZComponent)  # -> out, RoomsTopologies; inputs x: tree of Double, y: tree of Double, z: tree of Double; disabled
# ---------- python_3_script_7: Python ----------
import topologicpy

def data_tree_to_nested_list(data_tree, base_retrieval=lambda x: x[0]):
    """
    Converts a Grasshopper DataTree into a nested list structure.
    """
    def extend_list(path, depth, simple_data, nested_list):
        target_index = path[depth]
        if len(nested_list) <= target_index:
            nested_list.extend([None] * (target_index - len(nested_list) + 1))
        
        if depth == path.Length - 1:
            nested_list[target_index] = list(simple_data)
        else:
            if nested_list[target_index] is None:
                nested_list[target_index] = []
            extend_list(path, depth + 1, simple_data, nested_list[target_index])

    nested_structure = []
    for i in range(data_tree.BranchCount):
        branch_path = data_tree.Path(i)
        extend_list(branch_path, 0, data_tree.Branch(branch_path), nested_structure)
    
    return base_retrieval(nested_structure)

# Convert the Grasshopper DataTrees to nested lists
x_coords = data_tree_to_nested_list(x)
y_coords = data_tree_to_nested_list(y)
z_coords = data_tree_to_nested_list(z)

# Number of rooms to generate
total_rooms = len(x_coords)
print(f"Total Rooms to Generate: {total_rooms}")

# List to store rooms with vertices
RoomsTopologies = []

# Iterate over the coordinate sets
for room_index, (x_set, y_set, z_set) in enumerate(zip(x_coords, y_coords, z_coords), start=1):
    print(f"Start Generation Room {room_index} / {total_rooms}")
    vertices = [[x, y, z] for x, y, z in zip(x_set, y_set, z_set)]
    
    # Create topology from vertices
    room_topology = topologicpy.Topology.Topology.ByGeometry(vertices=vertices)
    RoomsTopologies.append(room_topology)

# Output the generated topologies
print("Generated Topologies of Rooms")
# ---------- end python_3_script_7 ----------
sort_list_3 = SortList(Keys=deconstruct_5.ZComponent, ValuesValuesA=cull_pattern_5)  # -> Keys, ValuesValuesA; disabled
sort_list_4 = SortList(Keys=deconstruct_6.ZComponent, ValuesValuesA=cull_pattern_6)  # -> Keys, ValuesValuesA; disabled
equality_4 = Equality(FirstNumber=deconstruct_4.ZComponent, SecondNumber=min_max_2.Minimum)  # -> Equality, Inequality; disabled
python_3_script_8 = Python3Script(topology=python_3_script_7.RoomsTopologies)  # -> out, geometry; disabled; same code as python_3_script_4
list_item_14 = ListItem(List=sort_list_3.ValuesValuesA, Index=0, Wrap=True)  # -> Item1, Item; disabled
list_item_15 = ListItem(List=sort_list_4.ValuesValuesA, Index=0, Wrap=True)  # -> Item1, Item; disabled
list_item_16 = ListItem(List=spatial_element_geometry_2.Geometry, Index=number_slider_7, Wrap=True)  # disabled
list_item_17 = ListItem(List=spatial_element_geometry_2.Geometry, Index=number_slider_8, Wrap=True)  # disabled
deconstruct_brep_7 = DeconstructBrep(Brep=list_item_17)  # -> Faces, Edges, Vertices; disabled
list_item_18 = ListItem(List=spatial_element_geometry_2.Geometry, Index=number_slider_9, Wrap=True)  # disabled
top_door_surfaces = Surface(list_item_14.Item1)  # disabled
panel_19 = Panel("50")  # disabled
top_door_surfaces_2 = Surface(list_item_15.Item1)  # disabled
point_list = PointList(Points=deconstruct_brep_7.Vertices, Size=panel_19)  # disabled
cull_pattern_7 = CullPattern(List=point, CullPattern=equality_4.Equality)  # disabled
project = Project(Geometry=top_door_surfaces, Plane=xy_plane)  # -> Geometry, Transform; disabled
top_door_surfaces_3 = Surface(simplify(flatten(project.Geometry)))  # disabled
deconstruct_brep_8 = DeconstructBrep(Brep=top_door_surfaces_3)  # -> Faces, Edges, Vertices; disabled
deconstruct_7 = Deconstruct(Point=deconstruct_brep_8.Vertices)  # -> XComponent, YComponent, ZComponent; disabled

# ---- group: Topology by Geometry
gh_brep_to_topology = Python3Script(GH_BREP=list_item_16)  # -> out, TOPOLOGY, TOPOLOGY_MERGED; inputs GH_BREP: list of Brep; disabled
# ---------- gh_brep_to_topology: Python ----------
import rhinoscriptsyntax as rs
import Rhino.Geometry as rg
from topologicpy.Topology import Topology
from topologicpy.Cluster import Cluster
from topologicpy.CellComplex import CellComplex

def extract_vertices(brep):
    vertices = brep.Vertices
    vertex_coords = [(v.Location.X, v.Location.Y, v.Location.Z) for v in vertices]
    return vertex_coords

def extract_edges(brep):
    vertices = extract_vertices(brep)
    edges = brep.Edges
    edge_indices = []
    for edge in edges:
        start = edge.PointAtStart
        end = edge.PointAtEnd
        start_index = None
        end_index = None

        # Find the indices of the start and end vertices
        for i, v in enumerate(vertices):
            if (round(v[0], 6), round(v[1], rnd_digits), round(v[2], rnd_digits)) == (round(start.X, rnd_digits), round(start.Y, rnd_digits), round(start.Z, rnd_digits)):
                start_index = i
            if (round(v[0], 6), round(v[1], rnd_digits), round(v[2], rnd_digits)) == (round(end.X, rnd_digits), round(end.Y, rnd_digits), round(end.Z, rnd_digits)):
                end_index = i

        if start_index is not None and end_index is not None:
            edge_indices.append([start_index, end_index])

    print("Extracted edges:", edge_indices)  # Output the extracted edges for verification
    return edge_indices

def extract_faces(brep):
    vertices = extract_vertices(brep)
    faces = brep.Faces
    face_indices = []

    for face in faces:
        face_loop_indices = []
        for loop in face.Loops:
            loop_edges = loop.To3dCurve().ToNurbsCurve().DuplicateSegments()

            for edge in loop_edges:
                start = edge.PointAtStart
                end = edge.PointAtEnd
                start_index = None
                end_index = None

                # Find the indices of the start and end vertices of the edges
                for i, v in enumerate(vertices):
                    if (round(v[0], rnd_digits), round(v[1], rnd_digits), round(v[2], rnd_digits)) == (round(start.X, rnd_digits), round(start.Y, rnd_digits), round(start.Z, rnd_digits)):
                        start_index = i
                    if (round(v[0], rnd_digits), round(v[1], rnd_digits), round(v[2], rnd_digits)) == (round(end.X, rnd_digits), round(end.Y, rnd_digits), round(end.Z, rnd_digits)):
                        end_index = i

                if start_index is not None:
                    face_loop_indices.append(start_index)
                if end_index is not None and end_index != start_index:
                    face_loop_indices.append(end_index)

        # Remove duplicate indices to ensure each vertex is only counted once per face
        face_loop_indices = list(dict.fromkeys(face_loop_indices))
        face_indices.append(face_loop_indices)

    print("Extracted faces:", face_indices)  # Output the extracted faces for verification
    return face_indices



TOPOLOGY = []
rnd_digits = 6

# Main program
for brep in GH_BREP:
    # Extract vertices
    vertices = extract_vertices(brep)
    print("Vertices:", vertices)

    # Extract edges
    edges = extract_edges(brep)
    print("Edges:", edges)

    # Extract faces
    faces = extract_faces(brep)
    print("Faces:", faces)

    # Create the topology and append it to the TOPOLOGY list

    topology = Topology.SelfMerge(Topology.ByGeometry(vertices=vertices, edges=edges, faces=faces, tolerance = 0.001))
    print("Created topology:", topology)
    TOPOLOGY.append(topology)

    print(Topology.Analyze(topology))

print("Final topology list:", TOPOLOGY)


#TOPOLOGY_MERGED = Cluster.ByTopologies(TOPOLOGY)

#TOPOLOGY_MERGED = CellComplex.
# ---------- end gh_brep_to_topology ----------

# ----
python_3_script_9 = Python3Script(x=deconstruct_7.XComponent, y=deconstruct_7.YComponent, z=deconstruct_7.ZComponent)  # -> out, VerticesOfRooms; inputs x: tree of Double, y: tree of Double, z: tree of Double; disabled
# ---------- python_3_script_9: Python ----------
import topologicpy

def data_tree_to_nested_list(data_tree, base_retrieval=lambda x: x[0]):
    """
    Converts a Grasshopper DataTree into a nested list structure.
    """
    def extend_list(path, depth, simple_data, nested_list):
        target_index = path[depth]
        if len(nested_list) <= target_index:
            nested_list.extend([None] * (target_index - len(nested_list) + 1))
        
        if depth == path.Length - 1:
            nested_list[target_index] = list(simple_data)
        else:
            if nested_list[target_index] is None:
                nested_list[target_index] = []
            extend_list(path, depth + 1, simple_data, nested_list[target_index])

    nested_structure = []
    for i in range(data_tree.BranchCount):
        branch_path = data_tree.Path(i)
        extend_list(branch_path, 0, data_tree.Branch(branch_path), nested_structure)
    
    return base_retrieval(nested_structure)

# Convert the Grasshopper DataTrees to nested lists
x_coords = data_tree_to_nested_list(x)
y_coords = data_tree_to_nested_list(y)
z_coords = data_tree_to_nested_list(z)

# Number of rooms to generate
total_rooms = len(x_coords)
print(f"Total Rooms to Generate: {total_rooms}")

# List to store rooms with vertices
VerticesOfRooms = []

# Iterate over the coordinate sets
for room_index, (x_set, y_set, z_set) in enumerate(zip(x_coords, y_coords, z_coords), start=1):
    print(f"Start Generation Room {room_index} / {total_rooms}")
    room_vertices = []
    for x, y, z in zip(x_set, y_set, z_set):
        # Create vertex from coordinates
        vertex = topologicpy.Vertex.Vertex.ByCoordinates(x, y, z)
        room_vertices.append(vertex)
    
    VerticesOfRooms.append(room_vertices)

# Output the generated vertex rooms
print("Generated Vertices of Rooms")
# ---------- end python_3_script_9 ----------
deconstruct_8 = Deconstruct(Point=cull_pattern_7)  # -> XComponent, YComponent, ZComponent; disabled
panel_20 = Panel("C:\Users\Schwarzes Biest\Desktop\Macad\Thesis\Topo.json")  # disabled
panel_21 = Panel("2800")  # disabled
unit_z_3 = UnitZ(Factor=panel_21)  # disabled
python_3_script_10 = Python3Script(VerticesOfRooms=python_3_script_9.VerticesOfRooms)  # -> out, FacesOfRooms; inputs VerticesOfRooms: list; disabled
# ---------- python_3_script_10: Python ----------
import topologicpy

FacesOfRooms = []

for vertices in VerticesOfRooms:
    FaceOfRoom = topologicpy.Face.Face.ByVertices(vertices)
    FacesOfRooms.append(FaceOfRoom)
# ---------- end python_3_script_10 ----------
boolean_toggle = BooleanToggle(True)  # disabled
python_3_script_11 = Python3Script(x=deconstruct_8.XComponent, y=deconstruct_8.YComponent, z=deconstruct_8.ZComponent)  # -> out, VerticesOfRooms; inputs x: tree of Double, y: tree of Double, z: tree of Double; disabled; same code as python_3_script_9

# ---- group: Faces from Cluster
python_3_script_12 = Python3Script(x=gh_brep_to_topology.TOPOLOGY)  # -> out, a; disabled
# ---------- python_3_script_12: Python ----------
from topologicpy.Cluster import Cluster

a = Cluster.Faces(x)
print(a)
# ---------- end python_3_script_12 ----------

# ---- group: Cell by Faces
python_3_script_13 = Python3Script(x=python_3_script_12.a)  # -> out, a, b; inputs x: list; disabled
# ---------- python_3_script_13: Python ----------
from topologicpy.Cell import Cell
from topologicpy.Topology import Topology


a = Cell.ByFaces(x)

b = Cell.Volume(a)

print(Topology.Analyze(a))
# ---------- end python_3_script_13 ----------

# ----
python_3_script_14 = Python3Script(TOPOLOGY=python_3_script_13.a, JSON_PATH=panel_20, OVERWRITE=boolean_toggle)  # -> out, a; inputs TOPOLOGY: list, JSON_PATH: String, OVERWRITE: Boolean; disabled
# ---------- python_3_script_14: Python ----------
from topologicpy.Topology import Topology

TOPOLOGY = [TOPOLOGY]

Topology.ExportToJSON(topologies=TOPOLOGY, path=JSON_PATH, overwrite=OVERWRITE)
# ---------- end python_3_script_14 ----------

# ---- group: Visualize
python_3_script_15 = Python3Script(topology=gh_brep_to_topology.TOPOLOGY)  # -> out, geometry; disabled; same code as python_3_script_4

# ----
panel_22 = Panel(python_3_script_11.out)  # disabled
python_3_script_16 = Python3Script(topology=python_3_script_10.FacesOfRooms)  # -> out, geometry; disabled; same code as python_3_script_4
python_3_script_17 = Python3Script(x=gh_brep_to_topology.TOPOLOGY_MERGED)  # -> out, topo_Graph, topo_Graph_Vertices, topo_Graph_Edges; disabled
# ---------- python_3_script_17: Python ----------
from topologicpy.Graph import Graph

topo_Graph = Graph.ByTopology(x)

topo_Graph_Vertices = Graph.Vertices(topo_Graph)

topo_Graph_Edges = Graph.Edges(topo_Graph, topo_Graph_Vertices)
# ---------- end python_3_script_17 ----------
python_3_script_18 = Python3Script(VerticesOfRooms=python_3_script_11.VerticesOfRooms)  # -> out, FacesOfRooms; inputs VerticesOfRooms: list; disabled; same code as python_3_script_10
merge_5 = Merge(Data1=python_3_script_11.VerticesOfRooms, Data2=python_3_script_9.VerticesOfRooms)  # -> flatten(Result); disabled
panel_23 = Panel(python_3_script_13.b)  # disabled
panel_24 = Panel(python_3_script_13.a)  # disabled
panel_25 = Panel(python_3_script_13.out)  # disabled
panel_26 = Panel("2000")  # disabled
python_3_script_19 = Python3Script(FacesOfRooms=python_3_script_18.FacesOfRooms, Heigth=panel_26)  # -> out, flatten(CellsRooms); inputs FacesOfRooms: list, Heigth: Double; disabled
# ---------- python_3_script_19: Python ----------
import topologicpy

CellsRooms = []

for Face in FacesOfRooms:
    CellRoom = topologicpy.Cell.Cell.ByThickenedFace(face = Face, thickness = Heigth, bothSides = False, reverse = True)
    CellsRooms.append(CellRoom)
# ---------- end python_3_script_19 ----------
python_3_script_20 = Python3Script(CellsRooms=python_3_script_19.CellsRooms)  # -> out, CellComplex; inputs CellsRooms: list; disabled
# ---------- python_3_script_20: Python ----------
import topologicpy

CellComplex = topologicpy.CellComplex.CellComplex.ByCells(CellsRooms)
# ---------- end python_3_script_20 ----------
python_3_script_21 = Python3Script(CellsRooms=python_3_script_19.CellsRooms)  # -> out, Cluster; inputs CellsRooms: list; disabled
# ---------- python_3_script_21: Python ----------
import topologicpy

Cluster = topologicpy.Cluster.Cluster.ByTopologies(CellsRooms)
# ---------- end python_3_script_21 ----------
python_3_script_22 = Python3Script(topology=python_3_script_21.Cluster)  # -> out, geometry; disabled; same code as python_3_script_4
python_3_script_23 = Python3Script(x=python_3_script_21.Cluster)  # -> out, topo_Graph, topo_Graph_Vertices, topo_Graph_Edges; disabled; same code as python_3_script_17
panel_27 = Panel("0.2")  # disabled
swatch = ColourSwatch(SwatchColor=RGB(255, 0, 0))  # disabled

# ----
# For Test_Model
levels_picker_3 = LevelsPicker(<levels picker referenced from the Revit model>)  # disabled
query_rooms = QueryRooms(Placed=True, Level=levels_picker_3)  # disabled
level_3 = Level(levels_picker_3)  # disabled
spatial_element_geometry_3 = SpatialElementGeometry(SpatialElement=query_rooms, BoundaryLocation=0)  # -> Geometry, TopFaces, SideFaces, BottomFaces; disabled

# ----
# Project rooms and door's top to the elevation of the chosen Revit level,
# so all rooms are in the same height (elevation).
panel_28 = Panel("Elevation")  # disabled
element_parameter_7 = ElementParameter(Element=level_3, Parameter=panel_28)  # -> Element, Value; disabled
construct_point_3 = ConstructPoint(XCoordinate=0, YCoordinate=0, ZCoordinate=element_parameter_7.Value)  # disabled
xy_plane_3 = XYPlane(Origin=construct_point_3)  # disabled

project_2 = Project(Geometry=spatial_element_geometry_3.BottomFaces, Plane=xy_plane_3)  # -> Geometry, Transform; disabled

project_3 = Project(Geometry=top_door_surfaces_2, Plane=xy_plane_3)  # -> Geometry, Transform; disabled
top_door_surfaces_4 = Surface(project_3.Geometry)  # disabled
rooms = Brep(project_2.Geometry)  # disabled
brep_5 = Brep(flatten([rooms, top_door_surfaces_4]))  # disabled
clean_tree = CleanTree(RemoveNulls=True, RemoveInvalid=True, RemoveEmpty=False, Tree=brep_5)  # disabled
extrude_2 = Extrude(Base=clean_tree, Direction=unit_z_3)  # disabled
brep_6 = Brep(extrude_2)  # disabled
deconstruct_brep_9 = DeconstructBrep(Brep=brep_6)  # -> Faces, Edges, Vertices; disabled

# ---- group: Get Vertices of Bottom Face
point_2 = Point(deconstruct_brep_9.Vertices)  # disabled
deconstruct_9 = Deconstruct(Point=point_2)  # -> XComponent, YComponent, ZComponent; disabled
min_max_3 = MinMax(Number=deconstruct_9.ZComponent)  # -> Minimum, Maximum; disabled
equality_5 = Equality(FirstNumber=deconstruct_9.ZComponent, SecondNumber=min_max_3.Minimum)  # -> Equality, Inequality; disabled
cull_pattern_8 = CullPattern(List=point_2, CullPattern=equality_5.Equality)  # disabled
deconstruct_10 = Deconstruct(Point=cull_pattern_8)  # -> XComponent, YComponent, ZComponent; disabled
python_3_script_24 = Python3Script(x=deconstruct_10.XComponent, y=deconstruct_10.YComponent, z=deconstruct_10.ZComponent)  # -> out, VerticesOfRooms; inputs x: tree of Double, y: tree of Double, z: tree of Double; disabled; same code as python_3_script_9

# ---- group: WIP Trying to construct directly from Faces
python_3_script_25 = Python3Script(Faces=deconstruct_brep_9.Faces, Vertices=deconstruct_brep_9.Vertices)  # -> out, Topology; inputs Faces: tree, Vertices: tree; disabled
# ---------- python_3_script_25: Python ----------
from topologicpy.Topology import Topology

def data_tree_to_nested_list(data_tree, base_retrieval=lambda x: x[0]):
    """
    Converts a Grasshopper DataTree into a nested list structure.
    """
    def extend_list(path, depth, simple_data, nested_list):
        target_index = path[depth]
        if len(nested_list) <= target_index:
            nested_list.extend([None] * (target_index - len(nested_list) + 1))
        
        if depth == path.Length - 1:
            nested_list[target_index] = list(simple_data)
        else:
            if nested_list[target_index] is None:
                nested_list[target_index] = []
            extend_list(path, depth + 1, simple_data, nested_list[target_index])

    nested_structure = []
    for i in range(data_tree.BranchCount):
        branch_path = data_tree.Path(i)
        extend_list(branch_path, 0, data_tree.Branch(branch_path), nested_structure)
    
    return base_retrieval(nested_structure)

# Convert the Grasshopper DataTrees to nested lists
Faces_of_Rooms = data_tree_to_nested_list(Faces)
Vertices_of_Rooms = data_tree_to_nested_list(Vertices)

Topology_out = []

for Room in Faces_of_Rooms:
    topo_Room = Topology.ByGeometry(faces = Room)
    Topology_out.append(topo_Room)
# ---------- end python_3_script_25 ----------

# ----
topology_bygeometry = TopologyByGeometry(Geometry=brep_6, Tolerance=0.0001)  # disabled
panel_29 = Panel(python_3_script_24.out)  # disabled

# ---- group: Generate topo_Faces
python_3_script_26 = Python3Script(VerticesOfRooms=python_3_script_24.VerticesOfRooms)  # -> out, FacesOfRooms; inputs VerticesOfRooms: list; disabled; same code as python_3_script_10

# ---- group: "Extrude" upwards
python_3_script_27 = Python3Script(FacesOfRooms=python_3_script_26.FacesOfRooms, Heigth=panel_21)  # -> out, flatten(CellsRooms); inputs FacesOfRooms: list, Heigth: Double; disabled; same code as python_3_script_19

# ---- group: Generate CellComplex / Cluster
python_3_script_28 = Python3Script(CellsRooms=python_3_script_27.CellsRooms)  # -> out, CellComplex; inputs CellsRooms: list; disabled; same code as python_3_script_20
python_3_script_29 = Python3Script(CellsRooms=python_3_script_27.CellsRooms)  # -> out, Cluster; inputs CellsRooms: list; disabled; same code as python_3_script_21

# ----
cellcomplex_bycells = CellComplexByCells(Cells=topology_bygeometry)  # disabled

# ---- group: Visualize
python_3_script_30 = Python3Script(topology=python_3_script_28.CellComplex)  # -> out, geometry; disabled; same code as python_3_script_4

# ----
graph_bytopology = GraphByTopology(
    Topology=cellcomplex_bycells,
    Direct=True,
    ViaSharedTopologies=False,
    ViaSharedApertures=False,
    ToExteriorTopologies=False,
    ToExteriorApertures=False,
    UseFaceInternalVertex=False,
    Tolerance=0.0001)  # disabled

# ---- group: Build Graph
python_3_script_31 = Python3Script(x=python_3_script_28.CellComplex)  # -> out, topo_Graph, topo_Graph_Vertices, topo_Graph_Edges; disabled; same code as python_3_script_17

# ----
graph_vertices = GraphVertices(Graph=graph_bytopology)  # disabled
graph_edges = GraphEdges(Graph=graph_bytopology, Vertices=graph_vertices, Tolerance=0.0001)  # disabled

edge_endvertex = EdgeEndVertex(Edge=graph_edges)  # disabled
edge_startvertex = EdgeStartVertex(Edge=graph_edges)  # disabled
topology_geometry = TopologyGeometry(Topology=edge_endvertex, Tolerance=0.0001)  # disabled
topology_geometry_2 = TopologyGeometry(Topology=edge_startvertex, Tolerance=0.0001)  # disabled

# ---- group: Find Start and End Vertices
python_3_script_32 = Python3Script(topo_Graph_edges=python_3_script_31.topo_Graph_Edges)  # -> out, topo_startVertex, topo_endVertex, startPoints, endPoints; inputs topo_Graph_edges: list; disabled
# ---------- python_3_script_32: Python ----------
from topologicpy.Edge import Edge
from topologicpy.Topology import Topology
import Rhino.Geometry as rg

# Initialize lists to store topology and point objects
topo_startVertex, topo_endVertex = [], []
startPoints, endPoints = [], []

# Iterate through each edge in the graph
for edge in topo_Graph_edges:
    # Extract start and end vertices
    sVertex = Edge.StartVertex(edge)
    eVertex = Edge.EndVertex(edge)
    
    # Append Topology vertices to the respective lists
    topo_startVertex.append(sVertex)
    topo_endVertex.append(eVertex)
    
    # Extract coordinates from the vertices
    sGeom = Topology.Geometry(sVertex)['vertices'][0]
    eGeom = Topology.Geometry(eVertex)['vertices'][0]
    
    # Convert coordinates to Point3d objects
    startPoints.append(rg.Point3d(*sGeom))
    endPoints.append(rg.Point3d(*eGeom))

# Outputs: Topology and Point3d objects for start and end vertices
print("Topology Start Vertices:", topo_startVertex)
print("Topology End Vertices:", topo_endVertex)
print("Start Points:", startPoints)
print("End Points:", endPoints)
# ---------- end python_3_script_32 ----------

# ----
ln = Line(StartPoint=topology_geometry_2, EndPoint=topology_geometry)  # disabled
panel_30 = Panel("0.2")  # disabled
swatch_2 = ColourSwatch(SwatchColor=RGB(255, 0, 0))  # disabled
pipe = Pipe(Curve=ln, Radius=panel_30, Caps=1)  # disabled

ln_2 = Line(StartPoint=python_3_script_32.startPoints, EndPoint=python_3_script_32.endPoints)  # disabled
pipe_2 = Pipe(Curve=ln_2, Radius=panel_27, Caps=1)  # disabled
preview = CustomPreview(Geometry=pipe, Material=swatch_2)  # disabled
preview_2 = CustomPreview(Geometry=pipe_2, Material=swatch)  # disabled

# ----
# Get Direction of Doors
element_host = ElementHost(Element=query_elements_6.Elements)
element_geometry_6 = ElementGeometry(Elements=element_host)  # -> flatten(Geometry)

# ----
# Isolate biggest Face
deconstruct_brep_10 = DeconstructBrep(Brep=element_geometry_6)  # -> Faces, Edges, Vertices
area_5 = Area(Geometry=deconstruct_brep_10.Faces)  # -> Area, Centroid
min_max_4 = MinMax(Number=area_5.Area)  # -> Minimum, Maximum
equality_6 = Equality(FirstNumber=area_5.Area, SecondNumber=min_max_4.Maximum)  # -> Equality, Inequality
cull_pattern_9 = CullPattern(List=deconstruct_brep_10.Faces, CullPattern=equality_6.Equality)  # -> flatten(List)

evaluate_surface = EvaluateSurface(Surface=surface, Point="{0,0,0}")  # -> Point, Normal, UDirection, VDirection, Frame
line_sdl = LineSDL(Start=evaluate_surface.Point, Direction=unit_z_2, Length=1)
rotate = Rotate(Vector=evaluate_surface.Normal, Axis=line_sdl, Angle=degrees("90"))
list_length = ListLength(List=cull_pattern_9)

# ----
# Get Center Point of Doors
element_geometry_7 = ElementGeometry(Elements=query_elements_6.Elements, DetailLevel=3)
list_item_19 = ListItem(List=element_geometry_7, Index=0, Wrap=True)  # -> Item, Item1, Item2
volume_2 = Volume(Geometry=list_item_19.Item)  # -> Volume, flatten(Centroid)

entwine_2 = Entwine(Branch00=point_on_curve, Branch01=volume_2.Centroid, FlattenInputs=True)

pull_point_2 = PullPoint(Point=entwine_2, Geometry=entwine, ClosestOnly=True)  # -> ClosestPoint, Distance

evaluate_surface_2 = EvaluateSurface(Surface=cull_pattern_9, Point="{0,0,0}")  # -> Point, Normal, UDirection, VDirection, Frame

entwine_3 = Entwine(Branch00=rotate, Branch01=evaluate_surface_2.UDirection, FlattenInputs=True)
entwine_4 = Entwine(Branch00=evaluate_surface.Point, Branch01=evaluate_surface_2.Point, FlattenInputs=True)

vector_display = VectorDisplay(Anchor=entwine_4, Vector=entwine_3)

# ----
# Create Faces representing Doors
number_slider_10 = Slider(0.45, range=0..3)
multiplication = Multiplication(A=Slider(400, range=0..1000), B=entwine_3)
point_3 = Point(pull_point_2.ClosestPoint)
negative = Negative(Value=multiplication)
move = Move(Geometry=point_3, Motion=multiplication)  # -> Geometry, Transform
move_2 = Move(Geometry=point_3, Motion=negative)  # -> Geometry, Transform
number_slider_11 = Slider(2.2, range=0..3)
unit_z_4 = UnitZ(Factor="2200")
move_3 = Move(Geometry=move_2.Geometry, Motion=unit_z_4)  # -> Geometry, Transform
move_4 = Move(Geometry=move.Geometry, Motion=unit_z_4)  # -> Geometry, Transform

merge_6 = Merge(Data1=move_3.Geometry, Data2=move_2.Geometry, Data3=move.Geometry, Data4=move_4.Geometry)
split_tree = SplitTree(Data=merge_6, Masks=flatten("{*;0}"))  # -> Positive, Negative
pt_roomdivline = Point(split_tree.Positive)
pt_doors = Point(split_tree.Negative)
partition_list = PartitionList(List=pt_doors, Size=list_length)
partition_list_2 = PartitionList(List=pt_roomdivline, Size=list_length)
path_mapper_2 = PathMapper(partition_list, source="{A;B;C}[i]", target="{A;B;i}[C]")
path_mapper_3 = PathMapper(partition_list_2, source="{A;B;C}[i]", target="{0;A;B;i}[C]")
shift_paths_7 = ShiftPaths(Data=path_mapper_3, Offset=-1)
merge_7 = Merge(Data1=shift_paths_7, Data2=path_mapper_2)
panel_31 = Panel(path_mapper_2)
path_mapper_4 = PathMapper(merge_7, source="{A;B;C}", target="{0;0;path_index}")

# ----
# Generate Door Faces
deconstruct_11 = Deconstruct(Point=path_mapper_4)  # -> XComponent, YComponent, ZComponent
python_3_script_33 = Python3Script(x=deconstruct_11.XComponent, y=deconstruct_11.YComponent, z=deconstruct_11.ZComponent)  # -> out, DoorFace; inputs x: tree of Double, y: tree of Double, z: tree of Double
# ---------- python_3_script_33: Python ----------
import topologicpy

def data_tree_to_nested_list(data_tree, base_retrieval=lambda x: x[0]):
    """
    Converts a Grasshopper DataTree into a nested list structure.
    """
    def extend_list(path, depth, simple_data, nested_list):
        target_index = path[depth]
        if len(nested_list) <= target_index:
            nested_list.extend([None] * (target_index - len(nested_list) + 1))
        
        if depth == path.Length - 1:
            nested_list[target_index] = list(simple_data)
        else:
            if nested_list[target_index] is None:
                nested_list[target_index] = []
            extend_list(path, depth + 1, simple_data, nested_list[target_index])

    nested_structure = []
    for i in range(data_tree.BranchCount):
        branch_path = data_tree.Path(i)
        extend_list(branch_path, 0, data_tree.Branch(branch_path), nested_structure)
    
    return base_retrieval(nested_structure)

# Convert the Grasshopper DataTrees to nested lists
x_coords = data_tree_to_nested_list(x)
y_coords = data_tree_to_nested_list(y)
z_coords = data_tree_to_nested_list(z)

# Determine the number of rooms
total_rooms = len(x_coords[0])
print(f"Total Rooms to Generate: {total_rooms}")

# List to store generated rooms
VerticesOfRooms = []
DoorFace = []

# Iterate over the coordinate sets for each room
for room_index, (x_set, y_set, z_set) in enumerate(zip(x_coords[0], y_coords[0], z_coords[0]), start=1):
    print(f"Start Generation Room {room_index} / {total_rooms}")
    room_vertices = []
    for x, y, z in zip(x_set, y_set, z_set):
        # Create a vertex from coordinates
        vertex = topologicpy.Vertex.Vertex.ByCoordinates(x, y, z)
        room_vertices.append(vertex)
    
    # Add vertices to the list
    VerticesOfRooms.append(room_vertices)
    
    # Create a face from the vertices
    face = topologicpy.Face.Face.ByVertices(room_vertices)
    DoorFace.append(face)

# Output the generated faces
print("Generated Bottom Faces of Rooms:", DoorFace)
# ---------- end python_3_script_33 ----------

python_3_script_34 = Python3Script(topology=python_3_script_33.DoorFace)  # -> out, geometry; same code as python_3_script_4

# ----
# Add Infos to Door
python_3_script_35 = Python3Script(Topo=python_3_script_33.DoorFace, Info1=merge_3, Info2=merge_2)  # -> out, TopoWithInfo; inputs Topo: list, Info1: list of String, Info2: list of String
# ---------- python_3_script_35: Python ----------
from topologicpy.Topology import Topology
from topologicpy.Dictionary import Dictionary

TopoWithInfo = []

for topo, info1, info2 in zip(Topo, Info1, Info2):
    # Create a list of keys and corresponding values
    keys = ["Info01", "Info02"]
    values = [info1, info2]
    
    # Create a single dictionary with both keys and values
    dictionary = Dictionary.ByKeysValues(keys, values)
    
    # Set the dictionary to the topology
    topo = Topology.SetDictionary(topo, dictionary)

    TopoWithInfo.append(topo)
# ---------- end python_3_script_35 ----------

panel_32 = Panel(python_3_script_35.TopoWithInfo)

# ----
# Merge
python_3_script_36 = Python3Script(CellComplex=python_3_script_3.CellComplex, Apertures=python_3_script_35.TopoWithInfo)  # -> out, Building; inputs Apertures: list
# ---------- python_3_script_36: Python ----------
from topologicpy.Topology import Topology

Building = Topology.AddApertures(CellComplex, Apertures, subTopologyType = "face", exclusive=True)
# ---------- end python_3_script_36 ----------

# ----
# Build and visualize Graph
python_3_script_37 = Python3Script(x=python_3_script_36.Building)  # -> out, topo_Graph, topo_Graph_Vertices, topo_Graph_Edges
# ---------- python_3_script_37: Python ----------
from topologicpy.Graph import Graph

topo_Graph = Graph.ByTopology(x, direct=False, viaSharedApertures=True)

topo_Graph_Vertices = Graph.Vertices(topo_Graph)

topo_Graph_Edges = Graph.Edges(topo_Graph, topo_Graph_Vertices)
# ---------- end python_3_script_37 ----------
python_3_script_38 = Python3Script(topo_Graph_edges=python_3_script_37.topo_Graph_Edges)  # -> out, topo_startVertex, topo_endVertex, startPoints, endPoints; inputs topo_Graph_edges: list; same code as python_3_script_32
ln_3 = Line(StartPoint=python_3_script_38.startPoints, EndPoint=python_3_script_38.endPoints)
pipe_3 = Pipe(Curve=ln_3, Radius="0.2", Caps=1)
preview_3 = CustomPreview(Geometry=pipe_3, Material=ColourSwatch(SwatchColor=RGB(58, 164, 0)))

# ----
# Export Graph
panel_33 = Panel("C:\Users\Schwarzes Biest\Desktop\Macad\Thesis\Topo.json")
python_3_script_39 = Python3Script(topo_Graph=python_3_script_37.topo_Graph, json_Path=panel_33)  # -> out, a; inputs json_Path: String
# ---------- python_3_script_39: Python ----------
from topologicpy.Graph import Graph

Graph.ExportToJSON(graph=topo_Graph,path=json_Path,overwrite=True)
# ---------- end python_3_script_39 ----------
