# Grasshopper definition 0801_RoomsWallsDoorsToGraph.gh (Grasshopper 1.0.8)
# plug-ins: Karamba3D, RhinoCodePluginGH, Heteroptera, RhinoInside.Revit.GH

# ----
# keys
panel = Panel("param1")
entwine = Entwine(Branch00=panel, Branch01="param2", FlattenInputs=True)  # disabled

# ----
# values
panel_2 = Panel("""a
s
d
f
g""")
panel_3 = Panel("""1
e
t
u
s""")
entwine_2 = Entwine(Branch00=panel_3, Branch01=panel_2, FlattenInputs=True)  # disabled

python_3_script = Python3Script(keys=entwine, values=entwine_2)  # -> out, keys_dict, values_dict; inputs keys: tree of String, values: tree of String; disabled
# ---------- python_3_script: Python ----------
from ghpythonlib import treehelpers as th

keys_dict = th.tree_to_list(keys)

values_dict =  th.tree_to_list(values)

print(keys_dict, values_dict)
# ---------- end python_3_script ----------
panel_4 = Panel(python_3_script.values_dict)  # disabled
panel_5 = Panel(python_3_script.keys_dict)  # disabled

wall_system_family = WallSystemFamily({"Basic": 0, "Curtain": 1, "Stacked": 2}, selected="Basic")  # disabled
query_walls = QueryWalls(WallSystemFamily=wall_system_family)  # disabled
element_geometry = ElementGeometry(Elements=query_walls, DetailLevel=3)  # disabled
deconstruct_brep = DeconstructBrep(Brep=element_geometry)  # -> Faces, Edges, Vertices; disabled
brep = Brep(deconstruct_brep.Faces)  # disabled

category = Category(<category referenced from the Revit model>)  # disabled
category_filter = CategoryFilter(Categories=category, Inverted=False)  # disabled
query_elements = QueryElements(Filter=category_filter, Limit=100)  # -> Elements, Count; disabled
element_geometry_2 = ElementGeometry(Elements=query_elements.Elements, DetailLevel=3)  # disabled
bounding_box = BoundingBox(Content=element_geometry_2, Plane=PlaneXY(0, 0, 0), UnionBox=True)  # -> Box, Box_2; disabled
deconstruct_brep_2 = DeconstructBrep(Brep=bounding_box.Box)  # -> Faces, Edges, Vertices; disabled
area = Area(Geometry=deconstruct_brep_2.Faces)  # -> Area, Centroid; disabled
sort_list = SortList(Keys=area.Area, ValuesValuesA=deconstruct_brep_2.Faces)  # -> Keys, ValuesValuesA; disabled
panel_6 = Panel("""0
1""")  # disabled
panel_7 = Panel("""4
5""")  # disabled
panel_8 = Panel("""2
3""")  # disabled
list_item = ListItem(List=sort_list.ValuesValuesA, Index=panel_6, Wrap=True)  # disabled
list_item_2 = ListItem(List=sort_list.ValuesValuesA, Index=panel_7, Wrap=True)  # disabled
list_item_3 = ListItem(List=sort_list.ValuesValuesA, Index=panel_8, Wrap=True)  # disabled
discontinuity = Discontinuity(Curve=list_item_2, Level=1)  # -> Points, Parameters; disabled
discontinuity_2 = Discontinuity(Curve=list_item, Level=1)  # -> Points, Parameters; disabled
discontinuity_3 = Discontinuity(Curve=list_item_3, Level=1)  # -> Points, Parameters; disabled
average = Average(Input=discontinuity.Points)  # disabled
average_2 = Average(Input=discontinuity_2.Points)  # disabled
average_3 = Average(Input=discontinuity_3.Points)  # disabled
shift_paths = ShiftPaths(Data=average, Offset=-1)  # disabled
shift_paths_2 = ShiftPaths(Data=average_2, Offset=-1)  # disabled
shift_paths_3 = ShiftPaths(Data=average_3, Offset=-1)  # disabled
list_item_4 = ListItem(List=simplify(shift_paths), Index=graft(panel_7), Wrap=True)  # -> Item, Item1; disabled
list_item_5 = ListItem(List=simplify(shift_paths_2), Index=graft(panel_6), Wrap=True)  # -> Item, Item1; disabled
list_item_6 = ListItem(List=simplify(shift_paths_3), Index=graft(panel_8), Wrap=True)  # -> Item, Item1; disabled
number_slider = Slider(352, range=0..1000)  # disabled
number_slider_2 = Slider(300, range=0..1000)  # disabled
number_slider_3 = Slider(99, range=0..1000)  # disabled
line = Line(StartPoint=list_item_4.Item, EndPoint=list_item_4.Item1)  # disabled
line_2 = Line(StartPoint=list_item_5.Item, EndPoint=list_item_5.Item1)  # disabled
line_3 = Line(StartPoint=list_item_6.Item, EndPoint=list_item_6.Item1)  # disabled
extend_curve = ExtendCurve(Curve=line, Type=0, Start=number_slider, End=number_slider)  # disabled
extend_curve_2 = ExtendCurve(Curve=line_2, Type=0, Start=number_slider_2, End=number_slider_2)  # disabled
extend_curve_3 = ExtendCurve(Curve=line_3, Type=0, Start=number_slider_3, End=number_slider_3)  # disabled
merge = Merge(Data1=extend_curve, Data2=extend_curve_2, Data3=extend_curve_3)  # disabled
bounding_box_2 = BoundingBox(Content=merge, Plane=PlaneXY(0, 0, 0), UnionBox=True)  # -> Box, Box_2; disabled

wall_system_family_2 = WallSystemFamily({"Basic": 0, "Curtain": 1, "Stacked": 2}, selected="Basic")
query_walls_2 = QueryWalls(WallSystemFamily=wall_system_family_2)
element_geometry_3 = ElementGeometry(Elements=query_walls_2, DetailLevel=3)
deconstruct_brep_3 = DeconstructBrep(Brep=element_geometry_3)  # -> Faces, Edges, Vertices
brep_2 = Brep(deconstruct_brep_3.Faces)

category_2 = Category(<category referenced from the Revit model>)
category_filter_2 = CategoryFilter(Categories=category_2, Inverted=False)
query_elements_2 = QueryElements(Filter=category_filter_2, Limit=100)  # -> Elements, Count
element_geometry_4 = ElementGeometry(Elements=query_elements_2.Elements, DetailLevel=3)
bounding_box_3 = BoundingBox(Content=element_geometry_4, Plane=PlaneXY(0, 0, 0), UnionBox=True)  # -> Box, Box_2
deconstruct_brep_4 = DeconstructBrep(Brep=bounding_box_3.Box)  # -> Faces, Edges, Vertices
area_2 = Area(Geometry=deconstruct_brep_4.Faces)  # -> Area, Centroid
sort_list_2 = SortList(Keys=area_2.Area, ValuesValuesA=deconstruct_brep_4.Faces)  # -> Keys, ValuesValuesA
panel_9 = Panel("""0
1""")
panel_10 = Panel("""4
5""")
panel_11 = Panel("""2
3""")
list_item_7 = ListItem(List=sort_list_2.ValuesValuesA, Index=panel_9, Wrap=True)
list_item_8 = ListItem(List=sort_list_2.ValuesValuesA, Index=panel_10, Wrap=True)
list_item_9 = ListItem(List=sort_list_2.ValuesValuesA, Index=panel_11, Wrap=True)
discontinuity_4 = Discontinuity(Curve=list_item_8, Level=1)  # -> Points, Parameters
discontinuity_5 = Discontinuity(Curve=list_item_7, Level=1)  # -> Points, Parameters
discontinuity_6 = Discontinuity(Curve=list_item_9, Level=1)  # -> Points, Parameters
average_4 = Average(Input=discontinuity_4.Points)
average_5 = Average(Input=discontinuity_5.Points)
average_6 = Average(Input=discontinuity_6.Points)
shift_paths_4 = ShiftPaths(Data=average_4, Offset=-1)
shift_paths_5 = ShiftPaths(Data=average_5, Offset=-1)
shift_paths_6 = ShiftPaths(Data=average_6, Offset=-1)
list_item_10 = ListItem(List=simplify(shift_paths_4), Index=graft(panel_10), Wrap=True)  # -> Item, Item1
list_item_11 = ListItem(List=simplify(shift_paths_5), Index=graft(panel_9), Wrap=True)  # -> Item, Item1
list_item_12 = ListItem(List=simplify(shift_paths_6), Index=graft(panel_11), Wrap=True)  # -> Item, Item1
number_slider_4 = Slider(352, range=0..1000)
number_slider_5 = Slider(300, range=0..1000)
number_slider_6 = Slider(99, range=0..1000)
line_4 = Line(StartPoint=list_item_10.Item, EndPoint=list_item_10.Item1)
line_5 = Line(StartPoint=list_item_11.Item, EndPoint=list_item_11.Item1)
line_6 = Line(StartPoint=list_item_12.Item, EndPoint=list_item_12.Item1)
extend_curve_4 = ExtendCurve(Curve=line_4, Type=0, Start=number_slider_4, End=number_slider_4)
extend_curve_5 = ExtendCurve(Curve=line_5, Type=0, Start=number_slider_5, End=number_slider_5)
extend_curve_6 = ExtendCurve(Curve=line_6, Type=0, Start=number_slider_6, End=number_slider_6)
merge_2 = Merge(Data1=extend_curve_4, Data2=extend_curve_5, Data3=extend_curve_6)
bounding_box_4 = BoundingBox(Content=merge_2, Plane=PlaneXY(0, 0, 0), UnionBox=True)  # -> Box, Box_2

analyze_wall_location_curve = AnalyzeWallLocationCurve(Wall=query_walls)  # -> LocationLine, CenterCurve, LocationCurve, OffsetValue; disabled
curve = Curve(analyze_wall_location_curve.CenterCurve)  # disabled
line_line_intersection_karamba3d = LineLineIntersectionKaramba3D(IntersectingLines=curve, LinesToIntersect=curve, LimitDistance_m=0.005)  # -> InterSecPoints, LineSubSegments; disabled
tree_statistics = TreeStatistics(Tree=line_line_intersection_karamba3d.LineSubSegments)  # -> Paths, Length, Count; disabled
partition_list = PartitionList(List=line_line_intersection_karamba3d.InterSecPoints, Size=tree_statistics.Length)  # disabled
curve_closest_point = CurveClosestPoint(Point=partition_list, Curve=reparameterize(graft(curve)))  # -> Point, Parameter, Distance; disabled
panel_12 = Panel("1")  # disabled
equality = Equality(FirstNumber=curve_closest_point.Parameter, SecondNumber=panel_12)  # -> Equality, Inequality; disabled
cull_pattern = CullPattern(List=curve_closest_point.Parameter, CullPattern=equality.Inequality)  # disabled
perp_frame = PerpFrame(Curve=reparameterize(graft(curve)), Parameter=cull_pattern)  # disabled

analyze_wall_location_curve_2 = AnalyzeWallLocationCurve(Wall=query_walls_2)  # -> LocationLine, CenterCurve, LocationCurve, OffsetValue
curve_2 = Curve(analyze_wall_location_curve_2.CenterCurve)
line_line_intersection_karamba3d_2 = LineLineIntersectionKaramba3D(IntersectingLines=curve_2, LinesToIntersect=curve_2, LimitDistance_m=0.005)  # -> InterSecPoints, LineSubSegments
tree_statistics_2 = TreeStatistics(Tree=line_line_intersection_karamba3d_2.LineSubSegments)  # -> Paths, Length, Count
partition_list_2 = PartitionList(List=line_line_intersection_karamba3d_2.InterSecPoints, Size=tree_statistics_2.Length)
curve_closest_point_2 = CurveClosestPoint(Point=partition_list_2, Curve=reparameterize(graft(curve_2)))  # -> Point, Parameter, Distance
equality_2 = Equality(FirstNumber=curve_closest_point_2.Parameter, SecondNumber="1")  # -> Equality, Inequality
cull_pattern_2 = CullPattern(List=curve_closest_point_2.Parameter, CullPattern=equality_2.Inequality)
perp_frame_2 = PerpFrame(Curve=reparameterize(graft(curve_2)), Parameter=cull_pattern_2)

area_3 = Area(Geometry=brep)  # -> Area, Centroid; disabled
area_4 = Area(Geometry=brep_2)  # -> Area, Centroid
deconstruct = Deconstruct(Point=area_3.Centroid)  # -> XComponent, YComponent, ZComponent; disabled
deconstruct_2 = Deconstruct(Point=area_4.Centroid)  # -> XComponent, YComponent, ZComponent
min_max = MinMax(Number=deconstruct.ZComponent)  # -> Minimum, Maximum; disabled
min_max_2 = MinMax(Number=deconstruct_2.ZComponent)  # -> Minimum, Maximum
equality_3 = Equality(FirstNumber=deconstruct.ZComponent, SecondNumber=min_max.Maximum)  # -> Equality, Inequality; disabled
equality_4 = Equality(FirstNumber=deconstruct_2.ZComponent, SecondNumber=min_max_2.Maximum)  # -> Equality, Inequality
cull_pattern_3 = CullPattern(List=brep, CullPattern=equality_3.Equality)  # disabled
cull_pattern_4 = CullPattern(List=brep_2, CullPattern=equality_4.Equality)
brep_3 = Brep(flatten(brep))  # disabled
brep_4 = Brep(flatten(brep_2))
shape_in_brep = ShapeInBrep(Brep=bounding_box_2.Box, Shape=brep_3)  # disabled
shape_in_brep_2 = ShapeInBrep(Brep=bounding_box_4.Box, Shape=brep_4)
inside = Panel("0")  # disabled
equality_5 = Equality(FirstNumber=shape_in_brep, SecondNumber=inside)  # -> Equality, Inequality; disabled
inside_2 = Panel("0")
equality_6 = Equality(FirstNumber=shape_in_brep_2, SecondNumber=inside_2)  # -> Equality, Inequality
cull_pattern_5 = CullPattern(List=brep_3, CullPattern=equality_5.Equality)  # disabled
cull_pattern_6 = CullPattern(List=brep_4, CullPattern=equality_6.Equality)
area_5 = Area(Geometry=cull_pattern_5)  # -> Area, Centroid; disabled
area_6 = Area(Geometry=cull_pattern_6)  # -> Area, Centroid
deconstruct_3 = Deconstruct(Point=area_5.Centroid)  # -> XComponent, YComponent, ZComponent; disabled
deconstruct_4 = Deconstruct(Point=area_6.Centroid)  # -> XComponent, YComponent, ZComponent
sort_list_3 = SortList(Keys=deconstruct_3.ZComponent, ValuesValuesA=cull_pattern_5)  # -> Keys, ValuesValuesA; disabled
sort_list_4 = SortList(Keys=deconstruct_4.ZComponent, ValuesValuesA=cull_pattern_6)  # -> Keys, ValuesValuesA
list_item_13 = ListItem(List=sort_list_3.ValuesValuesA, Index=0, Wrap=True)  # -> Item1, Item; disabled
list_item_14 = ListItem(List=sort_list_4.ValuesValuesA, Index=0, Wrap=True)  # -> Item1, Item
top_door_surfaces = Surface(list_item_13.Item1)  # disabled
top_door_surfaces_2 = Surface(list_item_14.Item1)
walls = Data(query_walls_2)
doors = Data(query_elements_2.Elements)
walls_2 = Data(walls)

# ----
# values
panel_13 = Panel("Category")
element_parameter = ElementParameter(Element=doors, Parameter=graft(panel_13))  # -> Element, Value
inspect_element = InspectElement(Element=doors)  # -> ConstraintsLevel, DimensionsHeight, DimensionsWidth
text_split = TextSplit(Text=element_parameter.Value, Separators=":")
text_split_2 = TextSplit(Text=inspect_element.ConstraintsLevel, Separators=":")
element_parameter_2 = ElementParameter(Element=doors, Parameter=graft("Family Name"))  # -> Element, Value
list_item_15 = ListItem(List=text_split, Index="1", Wrap=True)  # -> flatten(Item)
list_item_16 = ListItem(List=text_split_2, Index="1", Wrap=True)  # -> flatten(Item)
entwine_3 = Entwine(
    Branch00=list_item_16,
    Branch01=inspect_element.DimensionsHeight,
    Branch02=inspect_element.DimensionsWidth,
    FlattenInputs=True)
entwine_4 = Entwine(Branch00=list_item_15, Branch01=element_parameter_2.Value, FlattenInputs=True)
python_3_script_2 = Python3Script(list_a=simplify(entwine_4), list_b=simplify(entwine_3))  # -> out, merged_tree; inputs list_a: tree of String, list_b: tree of String
# ---------- python_3_script_2: Python ----------
import ghpythonlib.treehelpers as th
import Grasshopper as gh

# Assuming data_tree1 and data_tree2 are your input data trees
# Convert the input data trees to lists of lists
list1 = th.tree_to_list(list_a, None)
list2 = th.tree_to_list(list_b, None)

merged_lists = [list1, list2]

merged_tree = th.list_to_tree(merged_lists)
# ---------- end python_3_script_2 ----------
path_mapper = PathMapper(python_3_script_2.merged_tree, source="{A;B;C}", target="{path_index}")

inspect_element_2 = InspectElement(Element=walls_2)  # -> ConstraintsBaseConstraint, ConstraintsUnconnectedHeight, DimensionsLength, DimensionsArea

# ----
# values
panel_14 = Panel("Category")
element_parameter_3 = ElementParameter(Element=walls_2, Parameter=graft(panel_14))  # -> Element, Value
text_split_3 = TextSplit(Text=element_parameter_3.Value, Separators=":")
text_split_4 = TextSplit(Text=inspect_element_2.ConstraintsBaseConstraint, Separators=":")
element_parameter_4 = ElementParameter(Element=walls_2, Parameter=graft("Family Name"))  # -> Element, Value
list_item_17 = ListItem(List=text_split_3, Index="1", Wrap=True)  # -> flatten(Item)
list_item_18 = ListItem(List=text_split_4, Index="1", Wrap=True)  # -> flatten(Item)
entwine_5 = Entwine(
    Branch00=list_item_18,
    Branch01=inspect_element_2.DimensionsLength,
    Branch02=inspect_element_2.DimensionsArea,
    Branch03=inspect_element_2.ConstraintsUnconnectedHeight,
    FlattenInputs=True)
entwine_6 = Entwine(Branch00=list_item_17, Branch01=element_parameter_4.Value, FlattenInputs=True)
python_3_script_3 = Python3Script(list_a=simplify(entwine_6), list_b=simplify(entwine_5))  # -> out, merged_tree; inputs list_a: tree of String, list_b: tree of String; same code as python_3_script_2
path_mapper_2 = PathMapper(python_3_script_3.merged_tree, source="{A;B;C}", target="{path_index}")

inspect_element_3 = InspectElement(Element=walls)  # -> ConstraintsBaseConstraint, ConstraintsUnconnectedHeight, DimensionsLength, DimensionsArea

# ----
# values
panel_15 = Panel("Category")
element_parameter_5 = ElementParameter(Element=walls, Parameter=graft(panel_15))  # -> Element, Value
text_split_5 = TextSplit(Text=element_parameter_5.Value, Separators=":")
text_split_6 = TextSplit(Text=inspect_element_3.ConstraintsBaseConstraint, Separators=":")
element_parameter_6 = ElementParameter(Element=walls, Parameter=graft("Family Name"))  # -> Element, Value
list_item_19 = ListItem(List=text_split_5, Index="1", Wrap=True)  # -> flatten(Item)
list_item_20 = ListItem(List=text_split_6, Index="1", Wrap=True)  # -> flatten(Item)
entwine_7 = Entwine(
    Branch00=list_item_20,
    Branch01=inspect_element_3.DimensionsLength,
    Branch02=inspect_element_3.DimensionsArea,
    Branch03=inspect_element_3.ConstraintsUnconnectedHeight,
    FlattenInputs=True)
entwine_8 = Entwine(Branch00=list_item_19, Branch01=element_parameter_6.Value, FlattenInputs=True)
python_3_script_4 = Python3Script(list_a=simplify(entwine_8), list_b=simplify(entwine_7))  # -> out, merged_tree; inputs list_a: tree of String, list_b: tree of String; same code as python_3_script_2
path_mapper_3 = PathMapper(python_3_script_4.merged_tree, source="{A;B;C}", target="{path_index}")

# ----
# keys
list_length = ListLength(List=element_parameter_3.Value)
entwine_9 = Entwine(Branch00=panel_14, Branch01="Family Name", FlattenInputs=True)
duplicate_data = DuplicateData(Data=entwine_9, Number=list_length, Order=True)  # -> simplify(Data)
entwine_10 = Entwine(
    Branch00=inspect_element_2.ConstraintsBaseConstraint,
    Branch01=inspect_element_2.DimensionsLength,
    Branch02=inspect_element_2.DimensionsArea,
    Branch03=inspect_element_2.ConstraintsUnconnectedHeight,
    FlattenInputs=True)
parameter_identity = ParameterIdentity(Parameter=entwine_10)  # -> Guid, Name, Type, Group
python_3_script_5 = Python3Script(list_a=simplify(duplicate_data), list_b=simplify(parameter_identity.Name))  # -> out, merged_tree; inputs list_a: tree of String, list_b: tree of String; same code as python_3_script_2
path_mapper_4 = PathMapper(python_3_script_5.merged_tree, source="{A;B;C}", target="{path_index}")
create_set = CreateSet(List=path_mapper_4)  # -> Set, Map

# ----
# keys
list_length_2 = ListLength(List=element_parameter.Value)
entwine_11 = Entwine(Branch00=panel_13, Branch01="Family Name", FlattenInputs=True)
duplicate_data_2 = DuplicateData(Data=entwine_11, Number=list_length_2, Order=True)  # -> simplify(Data)
entwine_12 = Entwine(
    Branch00=inspect_element.ConstraintsLevel,
    Branch01=inspect_element.DimensionsHeight,
    Branch02=inspect_element.DimensionsWidth,
    FlattenInputs=True)
parameter_identity_2 = ParameterIdentity(Parameter=entwine_12)  # -> Guid, Name, Type, Group
python_3_script_6 = Python3Script(list_a=simplify(duplicate_data_2), list_b=simplify(parameter_identity_2.Name))  # -> out, merged_tree; inputs list_a: tree of String, list_b: tree of String; same code as python_3_script_2
path_mapper_5 = PathMapper(python_3_script_6.merged_tree, source="{A;B;C}", target="{path_index}")
create_set_2 = CreateSet(List=path_mapper_5)  # -> Set, Map

# ----
# keys
list_length_3 = ListLength(List=element_parameter_5.Value)
entwine_13 = Entwine(Branch00=panel_15, Branch01="Family Name", FlattenInputs=True)
duplicate_data_3 = DuplicateData(Data=entwine_13, Number=list_length_3, Order=True)  # -> simplify(Data)
entwine_14 = Entwine(
    Branch00=inspect_element_3.ConstraintsBaseConstraint,
    Branch01=inspect_element_3.DimensionsLength,
    Branch02=inspect_element_3.DimensionsArea,
    Branch03=inspect_element_3.ConstraintsUnconnectedHeight,
    FlattenInputs=True)
parameter_identity_3 = ParameterIdentity(Parameter=entwine_14)  # -> Guid, Name, Type, Group
python_3_script_7 = Python3Script(list_a=simplify(duplicate_data_3), list_b=simplify(parameter_identity_3.Name))  # -> out, merged_tree; inputs list_a: tree of String, list_b: tree of String; same code as python_3_script_2
path_mapper_6 = PathMapper(python_3_script_7.merged_tree, source="{A;B;C}", target="{path_index}")
create_set_3 = CreateSet(List=path_mapper_6)  # -> Set, Map

levels_picker = LevelsPicker(<levels picker referenced from the Revit model>)  # disabled
query_rooms = QueryRooms(Placed=True, Level=levels_picker)  # disabled
level = Level(levels_picker)  # disabled
spatial_element_geometry = SpatialElementGeometry(SpatialElement=query_rooms, BoundaryLocation=0)  # -> Geometry, TopFaces, SideFaces, BottomFaces; disabled

# ----
# Project rooms and door's top to the elevation of the chosen Revit level,
# so all rooms are in the same height (elevation).
panel_16 = Panel("Elevation")  # disabled
element_parameter_7 = ElementParameter(Element=level, Parameter=panel_16)  # -> Element, Value; disabled
construct_point = ConstructPoint(XCoordinate=0, YCoordinate=0, ZCoordinate=element_parameter_7.Value)  # disabled
xy_plane = XYPlane(Origin=construct_point)  # disabled

project = Project(Geometry=spatial_element_geometry.BottomFaces, Plane=xy_plane)  # -> Geometry, Transform; disabled

project_2 = Project(Geometry=cull_pattern_3, Plane=xy_plane)  # -> Geometry, Transform; disabled
brep_plane = BrepPlane(Brep=project_2.Geometry, Plane=perp_frame)  # -> Curves, Points; disabled
shift_paths_7 = ShiftPaths(Data=brep_plane.Curves, Offset=-1)  # disabled
surface_split = SurfaceSplit(Surface=project_2.Geometry, Curves=shift_paths_7)  # -> simplify(Fragments); disabled
project_3 = Project(Geometry=top_door_surfaces, Plane=xy_plane)  # -> Geometry, Transform; disabled

top_door_surfaces_3 = Surface(project_3.Geometry)  # disabled
rooms = Brep(project.Geometry)  # disabled
walls_3 = Surface(surface_split)  # disabled

# ----
# Selecting Walls with Doors
# (keeping tree structure)
area_7 = Area(Geometry=top_door_surfaces_3)  # -> Area, Centroid; disabled
point_in_curve = PointInCurve(Point=flatten(area_7.Centroid), Curve=graft(walls_3))  # -> Relationship, Point; disabled
panel_17 = Panel("2")  # disabled
equality_7 = Equality(FirstNumber=point_in_curve.Relationship, SecondNumber=panel_17)  # -> Equality, Inequality; disabled
cull_pattern_7 = CullPattern(List=point_in_curve.Relationship, CullPattern=equality_7.Equality)  # disabled
boolean = Boolean(cull_pattern_7)  # disabled
null_item = NullItem(Item=boolean)  # -> NullFlags, InvalidFlags, Description; disabled
dispatch = Dispatch(List=graft(walls_3), DispatchPattern=null_item.NullFlags)  # -> ListA, ListB; disabled

# ----
# Spliting walls with doors in two equal parts
# (keeping tree structure)
discontinuity_7 = Discontinuity(Curve=dispatch.ListB, Level=1)  # -> Points, Parameters; disabled
list_item_21 = ListItem(List=discontinuity_7.Points, Index=0, Wrap=True)  # -> Item, Item1, Item2, Item3; disabled
panel_18 = Panel("0.5")  # disabled
construct_point_2 = ConstructPoint(XCoordinate=panel_18, YCoordinate=panel_18, ZCoordinate=0)  # disabled
_4point_surface = _4PointSurface(CornerA=list_item_21.Item, CornerB=list_item_21.Item1, CornerC=list_item_21.Item2, CornerD=list_item_21.Item3)  # disabled
iso_curve = IsoCurve(Surface=reparameterize(_4point_surface), UVPoint=construct_point_2)  # -> UIsocurve, VIsocurve; disabled
surface_split_2 = SurfaceSplit(Surface=_4point_surface, Curves=iso_curve.VIsocurve)  # disabled
panel_19 = Panel("2500")  # disabled
unit_z = UnitZ(Factor=panel_19)  # disabled
extrude = Extrude(Base=surface_split_2, Direction=unit_z)  # disabled
number_slider_7 = Slider(12, range=0..100)  # disabled
point = Point(area_7.Centroid)  # disabled
brep_5 = Brep(simplify(extrude))  # disabled
clean_tree = CleanTree(RemoveNulls=True, RemoveInvalid=True, RemoveEmpty=True, Tree=brep_5)  # disabled
mesh_sphere = MeshSphere(Base=point, Radius=number_slider_7, UCount=10, VCount=20)  # disabled
clash = Clash(FirstSet=flatten(mesh_sphere), SecondSet=clean_tree, Distance=0, ResultLimit=100)  # -> ClashCount, ClashPoints, ClashRadii, FirstIndex, SecondIndex; disabled
boolean_2 = Boolean(invert(clash.SecondIndex))  # disabled
integer = Integer(boolean_2)  # disabled
list_item_22 = ListItem(List=clean_tree, Index=clash.SecondIndex, Wrap=True)  # disabled
list_item_23 = ListItem(List=clean_tree, Index=integer, Wrap=True)  # disabled

clean_tree_2 = CleanTree(RemoveNulls=True, RemoveInvalid=True, RemoveEmpty=False, Tree=flatten(rooms))  # disabled

# ----
# Walls without doors
brep_6 = Brep(dispatch.ListA)  # disabled
extrude_2 = Extrude(Base=brep_6, Direction=unit_z)  # disabled

extrude_3 = Extrude(Base=clean_tree_2, Direction=unit_z)  # disabled

walls_with_doors = Brep(list_item_23)  # disabled
walls_without_doors = Brep(extrude_2)  # disabled
rooms_2 = Brep(extrude_3)  # disabled
doors_2 = Brep(list_item_22)  # disabled

brep_edges = BrepEdges(Brep=rooms_2)  # -> Naked, Interior, NonManifold; disabled
colour_swatch = ColourSwatch(SwatchColor=RGB(61, 161, 255))  # disabled
colour_swatch_2 = ColourSwatch(SwatchColor=RGB(61, 161, 255))  # disabled
colour_swatch_3 = ColourSwatch(SwatchColor=RGB(227, 227, 227))  # disabled
colour_swatch_4 = ColourSwatch(SwatchColor=RGB(255, 242, 61))  # disabled
custom_preview = CustomPreview(Geometry=brep_edges.Interior, Material=colour_swatch_3)  # disabled
custom_preview_2 = CustomPreview(Geometry=walls_with_doors, Material=colour_swatch_2)  # disabled
custom_preview_3 = CustomPreview(Geometry=doors_2, Material=colour_swatch_4)  # disabled
custom_preview_4 = CustomPreview(Geometry=walls_without_doors, Material=colour_swatch)  # disabled

merge_3 = Merge(Data1=rooms_2, Data2=doors_2, Data3=walls_with_doors, Data4=walls_without_doors)  # -> flatten(Result); disabled
deconstruct_brep_5 = DeconstructBrep(Brep=merge_3)  # -> Faces, Edges, Vertices; disabled
deconstruct_5 = Deconstruct(Point=deconstruct_brep_5.Vertices)  # -> XComponent, YComponent, ZComponent; disabled
min_max_3 = MinMax(Number=flatten(deconstruct_5.ZComponent))  # -> Minimum, Maximum; disabled
equality_8 = Equality(FirstNumber=deconstruct_5.ZComponent, SecondNumber=min_max_3.Minimum)  # -> Equality, Inequality; disabled
cull_pattern_8 = CullPattern(List=deconstruct_brep_5.Vertices, CullPattern=equality_8.Equality)  # disabled
path_mapper_7 = PathMapper(cull_pattern_8, source="{A;B}", target="{0;A;B}")  # disabled

# ----
# Generate Bottom Faces of Rooms
deconstruct_6 = Deconstruct(Point=path_mapper_7)  # -> XComponent, YComponent, ZComponent; disabled
python_3_script_8 = Python3Script(x=deconstruct_6.XComponent, y=deconstruct_6.YComponent, z=deconstruct_6.ZComponent)  # -> out, RoomBottomFace; inputs x: tree of Double, y: tree of Double, z: tree of Double; disabled
# ---------- python_3_script_8: Python ----------
import topologicpy

def data_tree_to_nested_list(data_tree, base_retrieval=lambda x: x[0]):
    """
    Converts a Grasshopper DataTree into a nested list structure.
    """
    def extend_list(path, depth, simple_data, nested_list):
        target_index = path[depth]
        if len(nested_list) <= target_index:
            nested_list.extend([None] * (target_index - len(nested_list) + 1))
        
        if depth == path.Length - 1:
            nested_list[target_index] = list(simple_data)
        else:
            if nested_list[target_index] is None:
                nested_list[target_index] = []
            extend_list(path, depth + 1, simple_data, nested_list[target_index])

    nested_structure = []
    for i in range(data_tree.BranchCount):
        branch_path = data_tree.Path(i)
        extend_list(branch_path, 0, data_tree.Branch(branch_path), nested_structure)
    
    return base_retrieval(nested_structure)

# Convert the Grasshopper DataTrees to nested lists
x_coords = data_tree_to_nested_list(x)
y_coords = data_tree_to_nested_list(y)
z_coords = data_tree_to_nested_list(z)

# Determine the number of rooms
total_rooms = len(x_coords[0])
print(f"Total Rooms to Generate: {total_rooms}")

# List to store generated rooms
VerticesOfRooms = []
RoomBottomFace = []

# Iterate over the coordinate sets for each room
for room_index, (x_set, y_set, z_set) in enumerate(zip(x_coords[0], y_coords[0], z_coords[0]), start=1):
    print(f"Start Generation Room {room_index} / {total_rooms}")
    room_vertices = []
    print(room_vertices)
    for x, y, z in zip(x_set, y_set, z_set):
        # Create a vertex from coordinates
        vertex = topologicpy.Vertex.Vertex.ByCoordinates(x, y, z)
        room_vertices.append(vertex)
    
    # Add vertices to the list
    VerticesOfRooms.append(room_vertices)
    
    # Create a face from the vertices
    face = topologicpy.Face.Face.ByVertices(room_vertices)
    RoomBottomFace.append(face)

# Output the generated faces
print("Generated Bottom Faces of Rooms:", RoomBottomFace)
# ---------- end python_3_script_8 ----------

# ----
# Extrude Upwards
# >> Room Cells
panel_20 = Panel("5")  # disabled
python_3_script_9 = Python3Script(RoomBottomFace=python_3_script_8.RoomBottomFace, Heigth=panel_20)  # -> out, CellsRooms; inputs RoomBottomFace: list, Heigth: Double; disabled
# ---------- python_3_script_9: Python ----------
from topologicpy.Cell import Cell

CellsRooms = []

for Face in RoomBottomFace:
    CellRoom = Cell.ByThickenedFace(face = Face, thickness = Heigth, bothSides = False, reverse = True)
    CellsRooms.append(CellRoom)
# ---------- end python_3_script_9 ----------

# ----
# Convert to Cell Complex
python_3_script_10 = Python3Script(Cells=python_3_script_9.CellsRooms)  # -> out, CellComplex; inputs Cells: list; disabled
# ---------- python_3_script_10: Python ----------
from topologicpy.CellComplex import CellComplex

CellComplex = CellComplex.ByCells(Cells)
# ---------- end python_3_script_10 ----------

# ----
# Build Graph
python_3_script_11 = Python3Script(CellComplex=python_3_script_10.CellComplex)  # -> out, topo_Graph, topo_Graph_Vertices, topo_Graph_Edges; disabled
# ---------- python_3_script_11: Python ----------
from topologicpy.Graph import Graph

topo_Graph = Graph.ByTopology(CellComplex, direct=True, viaSharedApertures=False)

topo_Graph_Vertices = Graph.Vertices(topo_Graph)

topo_Graph_Edges = Graph.Edges(topo_Graph, vertices=topo_Graph_Vertices)

print(type(topo_Graph))

print(topo_Graph_Edges)
# ---------- end python_3_script_11 ----------

python_3_script_12 = Python3Script(topo_Graph=python_3_script_11.topo_Graph)  # -> out; disabled
# ---------- python_3_script_12: Python ----------
from topologicpy.Graph import Graph

path = "C:/Users/libny/Macad/thesis-iaac/20_TP_GRAPH_TO_CSV"
graphLabel = 1.0

Graph.ExportToCSV(topo_Graph, path, graphLabel, overwrite=True)
# ---------- end python_3_script_12 ----------

# ----
# Visualize Graph
python_3_script_13 = Python3Script(topo_Graph_edges=python_3_script_11.topo_Graph_Edges)  # -> out, topo_startVertex, topo_endVertex, startPoints, endPoints; inputs topo_Graph_edges: list; disabled
# ---------- python_3_script_13: Python ----------
from topologicpy.Edge import Edge
from topologicpy.Topology import Topology
import Rhino.Geometry as rg

# Initialize lists to store topology and point objects
topo_startVertex, topo_endVertex = [], []
startPoints, endPoints = [], []

# Iterate through each edge in the graph
for edge in topo_Graph_edges:
    # Extract start and end vertices
    sVertex = Edge.StartVertex(edge)
    eVertex = Edge.EndVertex(edge)
    
    # Append Topology vertices to the respective lists
    topo_startVertex.append(sVertex)
    topo_endVertex.append(eVertex)
    
    # Extract coordinates from the vertices
    sGeom = Topology.Geometry(sVertex)['vertices'][0]
    eGeom = Topology.Geometry(eVertex)['vertices'][0]
    
    # Convert coordinates to Point3d objects
    startPoints.append(rg.Point3d(*sGeom))
    endPoints.append(rg.Point3d(*eGeom))

# Outputs: Topology and Point3d objects for start and end vertices
print("Topology Start Vertices:", topo_startVertex)
print("Topology End Vertices:", topo_endVertex)
print("Start Points:", startPoints)
print("End Points:", endPoints)
# ---------- end python_3_script_13 ----------
swatch = ColourSwatch(SwatchColor=RGB(255, 143, 143))  # disabled
ln = Line(StartPoint=python_3_script_13.startPoints, EndPoint=python_3_script_13.endPoints)  # disabled
preview = CustomPreview(Geometry=ln, Material=swatch)  # disabled

panel_21 = Panel(python_3_script_12)  # disabled

levels_picker_2 = LevelsPicker(<levels picker referenced from the Revit model>)
query_rooms_2 = QueryRooms(Placed=True, Level=levels_picker_2)
level_2 = Level(levels_picker_2)
spatial_element_geometry_2 = SpatialElementGeometry(SpatialElement=query_rooms_2, BoundaryLocation=0)  # -> Geometry, TopFaces, SideFaces, BottomFaces

# ----
# Project rooms and door's top to the elevation of the chosen Revit level,
# so all rooms are in the same height (elevation).
panel_22 = Panel("Elevation")
element_parameter_8 = ElementParameter(Element=level_2, Parameter=panel_22)  # -> Element, Value
construct_point_3 = ConstructPoint(XCoordinate=0, YCoordinate=0, ZCoordinate=element_parameter_8.Value)
xy_plane_2 = XYPlane(Origin=construct_point_3)

project_4 = Project(Geometry=spatial_element_geometry_2.BottomFaces, Plane=xy_plane_2)  # -> Geometry, Transform

project_5 = Project(Geometry=cull_pattern_4, Plane=xy_plane_2)  # -> Geometry, Transform
brep_plane_2 = BrepPlane(Brep=project_5.Geometry, Plane=perp_frame_2)  # -> Curves, Points
shift_paths_8 = ShiftPaths(Data=brep_plane_2.Curves, Offset=-1)
surface_split_3 = SurfaceSplit(Surface=project_5.Geometry, Curves=shift_paths_8)  # -> simplify(Fragments)
project_6 = Project(Geometry=top_door_surfaces_2, Plane=xy_plane_2)  # -> Geometry, Transform

top_door_surfaces_4 = Surface(project_6.Geometry)
rooms_3 = Brep(project_4.Geometry)
walls_4 = Surface(surface_split_3)

# ----
# Selecting Walls with Doors
# (keeping tree structure)
area_8 = Area(Geometry=top_door_surfaces_4)  # -> Area, Centroid
point_in_curve_2 = PointInCurve(Point=flatten(area_8.Centroid), Curve=graft(walls_4))  # -> Relationship, Point
equality_9 = Equality(FirstNumber=point_in_curve_2.Relationship, SecondNumber="2")  # -> Equality, Inequality
cull_pattern_9 = CullPattern(List=point_in_curve_2.Relationship, CullPattern=equality_9.Equality)
boolean_3 = Boolean(cull_pattern_9)
null_item_2 = NullItem(Item=boolean_3)  # -> NullFlags, InvalidFlags, Description
dispatch_2 = Dispatch(List=graft(walls_4), DispatchPattern=null_item_2.NullFlags)  # -> ListA, ListB

# ----
# Spliting walls with doors in two equal parts
# (keeping tree structure)
discontinuity_8 = Discontinuity(Curve=dispatch_2.ListB, Level=1)  # -> Points, Parameters
list_item_24 = ListItem(List=discontinuity_8.Points, Index=0, Wrap=True)  # -> Item, Item1, Item2, Item3
construct_point_4 = ConstructPoint(XCoordinate="0.5", YCoordinate="0.5", ZCoordinate=0)
_4point_surface_2 = _4PointSurface(CornerA=list_item_24.Item, CornerB=list_item_24.Item1, CornerC=list_item_24.Item2, CornerD=list_item_24.Item3)
iso_curve_2 = IsoCurve(Surface=reparameterize(_4point_surface_2), UVPoint=construct_point_4)  # -> UIsocurve, VIsocurve
surface_split_4 = SurfaceSplit(Surface=_4point_surface_2, Curves=iso_curve_2.VIsocurve)
unit_z_2 = UnitZ(Factor="2500")
extrude_4 = Extrude(Base=surface_split_4, Direction=unit_z_2)
point_2 = Point(area_8.Centroid)
brep_7 = Brep(simplify(extrude_4))
clean_tree_3 = CleanTree(RemoveNulls=True, RemoveInvalid=True, RemoveEmpty=True, Tree=brep_7)
mesh_sphere_2 = MeshSphere(Base=point_2, Radius=Slider(12, range=0..100), UCount=10, VCount=20)
clash_2 = Clash(FirstSet=flatten(mesh_sphere_2), SecondSet=clean_tree_3, Distance=0, ResultLimit=100)  # -> ClashCount, ClashPoints, ClashRadii, FirstIndex, SecondIndex
boolean_4 = Boolean(invert(clash_2.SecondIndex))
integer_2 = Integer(boolean_4)
list_item_25 = ListItem(List=clean_tree_3, Index=clash_2.SecondIndex, Wrap=True)
list_item_26 = ListItem(List=clean_tree_3, Index=integer_2, Wrap=True)

clean_tree_4 = CleanTree(RemoveNulls=True, RemoveInvalid=True, RemoveEmpty=False, Tree=flatten(rooms_3))

# ----
# Walls without doors
brep_8 = Brep(dispatch_2.ListA)
extrude_5 = Extrude(Base=brep_8, Direction=unit_z_2)

extrude_6 = Extrude(Base=clean_tree_4, Direction=unit_z_2)

walls_without_doors_2 = Brep(simplify(extrude_5))
rooms_4 = Brep(extrude_6)
walls_with_doors_2 = Brep(simplify(list_item_26))
doors_3 = Brep(simplify(list_item_25))

merge_4 = Merge(Data1=rooms_4)  # -> flatten(Result)
deconstruct_brep_6 = DeconstructBrep(Brep=merge_4)  # -> Faces, Edges, Vertices
deconstruct_7 = Deconstruct(Point=deconstruct_brep_6.Vertices)  # -> XComponent, YComponent, ZComponent
min_max_4 = MinMax(Number=flatten(deconstruct_7.ZComponent))  # -> Minimum, Maximum
equality_10 = Equality(FirstNumber=deconstruct_7.ZComponent, SecondNumber=min_max_4.Minimum)  # -> Equality, Inequality
cull_pattern_10 = CullPattern(List=deconstruct_brep_6.Vertices, CullPattern=equality_10.Equality)

brep_edges_2 = BrepEdges(Brep=rooms_4)  # -> Naked, Interior, NonManifold
custom_preview_5 = CustomPreview(Geometry=brep_edges_2.Interior, Material=ColourSwatch(SwatchColor=RGB(227, 227, 227)))
custom_preview_6 = CustomPreview(Geometry=walls_with_doors_2, Material=ColourSwatch(SwatchColor=RGB(61, 161, 255)))
custom_preview_7 = CustomPreview(Geometry=doors_3, Material=ColourSwatch(SwatchColor=RGB(255, 242, 61)))
custom_preview_8 = CustomPreview(Geometry=walls_without_doors_2, Material=ColourSwatch(SwatchColor=RGB(61, 161, 255)))

# ----
# topology
deconstruct_brep_7 = DeconstructBrep(Brep=walls_without_doors_2)  # -> Faces, Edges, Vertices
deconstruct_8 = Deconstruct(Point=deconstruct_brep_7.Vertices)  # -> XComponent, YComponent, ZComponent
min_max_5 = MinMax(Number=flatten(deconstruct_8.ZComponent))  # -> Minimum, Maximum
equality_11 = Equality(FirstNumber=deconstruct_8.ZComponent, SecondNumber=min_max_5.Minimum)  # -> Equality, Inequality
cull_pattern_11 = CullPattern(List=deconstruct_brep_7.Vertices, CullPattern=equality_11.Equality)
path_mapper_8 = PathMapper(cull_pattern_11, source="{A;B;C}", target="{0;0;path_index}")
deconstruct_9 = Deconstruct(Point=path_mapper_8)  # -> XComponent, YComponent, ZComponent
python_3_script_14 = Python3Script(x=deconstruct_9.XComponent, y=deconstruct_9.YComponent, z=deconstruct_9.ZComponent)  # -> out, RoomBottomFace; inputs x: tree of Double, y: tree of Double, z: tree of Double
# ---------- python_3_script_14: Python ----------
import topologicpy

def data_tree_to_nested_list(data_tree, base_retrieval=lambda x: x[0]):
    """
    Converts a Grasshopper DataTree into a nested list structure.
    """
    def extend_list(path, depth, simple_data, nested_list):
        target_index = path[depth]
        if len(nested_list) <= target_index:
            nested_list.extend([None] * (target_index - len(nested_list) + 1))
        
        if depth == path.Length - 1:
            nested_list[target_index] = list(simple_data)
        else:
            if nested_list[target_index] is None:
                nested_list[target_index] = []
            extend_list(path, depth + 1, simple_data, nested_list[target_index])

    nested_structure = []
    for i in range(data_tree.BranchCount):
        branch_path = data_tree.Path(i)
        extend_list(branch_path, 0, data_tree.Branch(branch_path), nested_structure)
    
    return base_retrieval(nested_structure)

# Convert the Grasshopper DataTrees to nested lists
x_coords = data_tree_to_nested_list(x)
y_coords = data_tree_to_nested_list(y)
z_coords = data_tree_to_nested_list(z)

# Determine the number of rooms
total_rooms = len(x_coords[0])
print(f"Total Rooms to Generate: {total_rooms}")

# List to store generated rooms
VerticesOfRooms = []
RoomBottomFace = []

# Iterate over the coordinate sets for each room
for room_index, (x_set, y_set, z_set) in enumerate(zip(x_coords[0], y_coords[0], z_coords[0]), start=1):
    print(f"Start Generation Room {room_index} / {total_rooms}")
    room_vertices = []
    for x, y, z in zip(x_set, y_set, z_set):
        # Create a vertex from coordinates
        vertex = topologicpy.Vertex.Vertex.ByCoordinates(x, y, z)
        room_vertices.append(vertex)
    
    # Add vertices to the list
    VerticesOfRooms.append(room_vertices)
    
    # Create a face from the vertices
    face = topologicpy.Face.Face.ByVertices(room_vertices)
    RoomBottomFace.append(face)

# Output the generated faces
print("Generated Bottom Faces of Rooms:", RoomBottomFace)
# ---------- end python_3_script_14 ----------
python_3_script_15 = Python3Script(RoomBottomFace=python_3_script_14.RoomBottomFace, Heigth="5")  # -> out, Cells; inputs RoomBottomFace: list, Heigth: Double
# ---------- python_3_script_15: Python ----------
from topologicpy.Cell import Cell

Cells = []

for Face in RoomBottomFace:
    CellRoom = Cell.ByThickenedFace(face = Face, thickness = Heigth, bothSides = False, reverse = True)
    Cells.append(CellRoom)
# ---------- end python_3_script_15 ----------

# ----
# topology
deconstruct_brep_8 = DeconstructBrep(Brep=doors_3)  # -> Faces, Edges, Vertices
deconstruct_10 = Deconstruct(Point=deconstruct_brep_8.Vertices)  # -> XComponent, YComponent, ZComponent
min_max_6 = MinMax(Number=flatten(deconstruct_10.ZComponent))  # -> Minimum, Maximum
equality_12 = Equality(FirstNumber=deconstruct_10.ZComponent, SecondNumber=min_max_6.Minimum)  # -> Equality, Inequality
cull_pattern_12 = CullPattern(List=deconstruct_brep_8.Vertices, CullPattern=equality_12.Equality)
path_mapper_9 = PathMapper(cull_pattern_12, source="{A;B;C}", target="{0;0;path_index}")
deconstruct_11 = Deconstruct(Point=path_mapper_9)  # -> XComponent, YComponent, ZComponent
python_3_script_16 = Python3Script(x=deconstruct_11.XComponent, y=deconstruct_11.YComponent, z=deconstruct_11.ZComponent)  # -> out, RoomBottomFace; inputs x: tree of Double, y: tree of Double, z: tree of Double; same code as python_3_script_14
python_3_script_17 = Python3Script(RoomBottomFace=python_3_script_16.RoomBottomFace, Heigth="5")  # -> out, Cells; inputs RoomBottomFace: list, Heigth: Double; same code as python_3_script_15

# ----
# topology
deconstruct_brep_9 = DeconstructBrep(Brep=walls_with_doors_2)  # -> Faces, Edges, Vertices
deconstruct_12 = Deconstruct(Point=deconstruct_brep_9.Vertices)  # -> XComponent, YComponent, ZComponent
min_max_7 = MinMax(Number=flatten(deconstruct_12.ZComponent))  # -> Minimum, Maximum
equality_13 = Equality(FirstNumber=deconstruct_12.ZComponent, SecondNumber=min_max_7.Minimum)  # -> Equality, Inequality
cull_pattern_13 = CullPattern(List=deconstruct_brep_9.Vertices, CullPattern=equality_13.Equality)
path_mapper_10 = PathMapper(cull_pattern_13, source="{A;B;C}", target="{0;0;path_index}")
deconstruct_13 = Deconstruct(Point=path_mapper_10)  # -> XComponent, YComponent, ZComponent
python_3_script_18 = Python3Script(x=deconstruct_13.XComponent, y=deconstruct_13.YComponent, z=deconstruct_13.ZComponent)  # -> out, RoomBottomFace; inputs x: tree of Double, y: tree of Double, z: tree of Double; same code as python_3_script_14
python_3_script_19 = Python3Script(RoomBottomFace=python_3_script_18.RoomBottomFace, Heigth="5")  # -> out, Cells; inputs RoomBottomFace: list, Heigth: Double; same code as python_3_script_15

# ----
# Generate Bottom Faces of Rooms, Doors and Walls
path_mapper_11 = PathMapper(cull_pattern_10, source="{A;B}", target="{0;A;B}")
deconstruct_14 = Deconstruct(Point=path_mapper_11)  # -> XComponent, YComponent, ZComponent
python_3_script_20 = Python3Script(x=deconstruct_14.XComponent, y=deconstruct_14.YComponent, z=deconstruct_14.ZComponent)  # -> out, RoomBottomFace; inputs x: tree of Double, y: tree of Double, z: tree of Double; same code as python_3_script_14

# ----
# Extrude Upwards
# >> Room Cells
panel_23 = Panel("5")
python_3_script_21 = Python3Script(RoomBottomFace=python_3_script_20.RoomBottomFace, Heigth=panel_23)  # -> out, CellsRooms; inputs RoomBottomFace: list, Heigth: Double; same code as python_3_script_9

# ----
# DOORS
keys = Text(create_set_2.Set)
values = Data(path_mapper)
python_3_script_22 = Python3Script(keys=keys, values=values)  # -> out, keys_dict, values_dict; inputs keys: tree of String, values: tree of String
# ---------- python_3_script_22: Python ----------
from ghpythonlib import treehelpers as th

keys_dict = th.tree_to_list(keys, None)

values_dict =  th.tree_to_list(values, None)

print(keys_dict, values_dict)
# ---------- end python_3_script_22 ----------
python_3_script_23 = Python3Script(Topo=python_3_script_17.Cells, keys=python_3_script_22.keys_dict, values=python_3_script_22.values_dict)  # -> out, TopoWithData; inputs Topo: list, keys: list of String, values: list of String
# ---------- python_3_script_23: Python ----------
from topologicpy.Topology import Topology
from topologicpy.Dictionary import Dictionary

TopoWithInfo = []

for topo, info1, info2 in zip(Topo, keys, values):
    
    # Create a single dictionary with both keys and values
    dictionary = Dictionary.ByKeysValues(keys, values)
    
    # Set the dictionary to the topology
    topo = Topology.SetDictionary(topo, dictionary)

    TopoWithInfo.append(topo)
# ---------- end python_3_script_23 ----------

# ----
# WALLS without DOORS
keys_2 = Text(create_set.Set)
values_2 = Data(path_mapper_2)
python_3_script_24 = Python3Script(keys=keys_2, values=values_2)  # -> out, keys_dict, values_dict; inputs keys: tree of String, values: tree of String; same code as python_3_script_22
python_3_script_25 = Python3Script(Topo=python_3_script_15.Cells, keys=python_3_script_24.keys_dict, values=python_3_script_24.values_dict)  # -> out, TopoWithData; inputs Topo: list, keys: list of String, values: list of String; same code as python_3_script_23

# ----
# WALLS with DOORS
keys_3 = Text(create_set_3.Set)
values_3 = Data(path_mapper_3)
python_3_script_26 = Python3Script(keys=keys_3, values=values_3)  # -> out, keys_dict, values_dict; inputs keys: tree of String, values: tree of String; same code as python_3_script_22
python_3_script_27 = Python3Script(Topo=python_3_script_19.Cells, keys=python_3_script_26.keys_dict, values=python_3_script_26.values_dict)  # -> out, TopoWithData; inputs Topo: list, keys: list of String, values: list of String; same code as python_3_script_23

# ----
# Convert to Cell Complex
python_3_script_28 = Python3Script(Cells=python_3_script_21.CellsRooms)  # -> out, CellComplex; inputs Cells: list; same code as python_3_script_10

# ----
# Build Graph
python_3_script_29 = Python3Script(CellComplex=python_3_script_28.CellComplex)  # -> out, topo_Graph, topo_Graph_Vertices, topo_Graph_Edges; same code as python_3_script_11

python_3_script_30 = Python3Script(topo_Graph=python_3_script_29.topo_Graph)  # -> out; same code as python_3_script_12

# ----
# Visualize Graph
python_3_script_31 = Python3Script(topo_Graph_edges=python_3_script_29.topo_Graph_Edges)  # -> out, topo_startVertex, topo_endVertex, startPoints, endPoints; inputs topo_Graph_edges: list; same code as python_3_script_13
ln_2 = Line(StartPoint=python_3_script_31.startPoints, EndPoint=python_3_script_31.endPoints)
preview_2 = CustomPreview(Geometry=ln_2, Material=ColourSwatch(SwatchColor=RGB(255, 143, 143)))

panel_24 = Panel(python_3_script_30)
