# Grasshopper definition topologicpy-tutorial_LPA.gh (Grasshopper 1.0.8)
# plug-ins: RhinoCodePluginGH, RhinoInside.Revit.GH, TopologicGH

brep = Brep([<brep referenced from the Rhino model> x6])  # disabled
topology_bygeometry = TopologyByGeometry(Geometry=brep, Tolerance=0.0001)  # disabled
cellcomplex_bycells = CellComplexByCells(Cells=topology_bygeometry)  # disabled
graph_bytopology = GraphByTopology(
    Topology=cellcomplex_bycells,
    Direct=True,
    ViaSharedTopologies=False,
    ViaSharedApertures=False,
    ToExteriorTopologies=False,
    ToExteriorApertures=False,
    UseFaceInternalVertex=False,
    Tolerance=0.0001)  # disabled
graph_vertices = GraphVertices(Graph=graph_bytopology)  # disabled
graph_edges = GraphEdges(Graph=graph_bytopology, Vertices=graph_vertices, Tolerance=0.0001)  # disabled

edge_endvertex = EdgeEndVertex(Edge=graph_edges)  # disabled
edge_startvertex = EdgeStartVertex(Edge=graph_edges)  # disabled
topology_geometry = TopologyGeometry(Topology=edge_endvertex, Tolerance=0.0001)  # disabled
topology_geometry_2 = TopologyGeometry(Topology=edge_startvertex, Tolerance=0.0001)  # disabled

ln = Line(StartPoint=topology_geometry_2, EndPoint=topology_geometry)  # disabled
panel = Panel("0.2")  # disabled
swatch = ColourSwatch(SwatchColor=RGB(255, 0, 0))  # disabled
pipe = Pipe(Curve=ln, Radius=panel, Caps=1)  # disabled

preview = CustomPreview(Geometry=pipe, Material=swatch)  # disabled
number_slider = Slider(9, range=0..10)  # disabled
number_slider_2 = Slider(10, range=0..10)  # disabled
number_slider_3 = Slider(8, range=0..10)  # disabled
panel_2 = Panel("\"C:\\Users\\libny\\Macad\\thesis-iaac\\01_GH_SCRIPTS\\creating_graph_with_topologic_LPA.py\"")  # disabled
y = Slider(5, range=0..10)  # disabled
wall_system_family = WallSystemFamily({"Basic": 0, "Curtain": 1, "Stacked": 2}, selected="Basic")  # disabled
wall_system_family_2 = WallSystemFamily({"Basic": 0, "Curtain": 1, "Stacked": 2}, selected="Basic")  # disabled

wall_system_family_3 = WallSystemFamily({"Basic": 0, "Curtain": 1, "Stacked": 2}, selected="Basic")  # disabled
query_walls = QueryWalls(WallSystemFamily=wall_system_family_3)  # disabled
element_geometry = ElementGeometry(Elements=query_walls, DetailLevel=3)  # disabled
deconstruct_brep = DeconstructBrep(Brep=element_geometry)  # -> Faces, Edges, Vertices; disabled
brep_2 = Brep(flatten(deconstruct_brep.Faces))  # disabled

category = Category(<category referenced from the Revit model>)  # disabled
category_filter = CategoryFilter(Categories=category, Inverted=False)  # disabled
query_elements = QueryElements(Filter=category_filter, Limit=100)  # -> Elements, Count; disabled
element_geometry_2 = ElementGeometry(Elements=query_elements.Elements, DetailLevel=3)  # disabled
bounding_box = BoundingBox(Content=element_geometry_2, Plane=PlaneXY(0, 0, 0), UnionBox=True)  # -> Box, Box_2; disabled
deconstruct_brep_2 = DeconstructBrep(Brep=bounding_box.Box)  # -> Faces, Edges, Vertices; disabled
area = Area(Geometry=deconstruct_brep_2.Faces)  # -> Area, Centroid; disabled
sort_list = SortList(Keys=area.Area, ValuesValuesA=deconstruct_brep_2.Faces)  # -> Keys, ValuesValuesA; disabled
panel_3 = Panel("""0
1""")  # disabled
panel_4 = Panel("""4
5""")  # disabled
panel_5 = Panel("""2
3""")  # disabled
list_item = ListItem(List=sort_list.ValuesValuesA, Index=panel_3, Wrap=True)  # disabled
list_item_2 = ListItem(List=sort_list.ValuesValuesA, Index=panel_4, Wrap=True)  # disabled
list_item_3 = ListItem(List=sort_list.ValuesValuesA, Index=panel_5, Wrap=True)  # disabled
discontinuity = Discontinuity(Curve=list_item_2, Level=1)  # -> Points, Parameters; disabled
discontinuity_2 = Discontinuity(Curve=list_item, Level=1)  # -> Points, Parameters; disabled
discontinuity_3 = Discontinuity(Curve=list_item_3, Level=1)  # -> Points, Parameters; disabled
average = Average(Input=discontinuity.Points)  # disabled
average_2 = Average(Input=discontinuity_2.Points)  # disabled
average_3 = Average(Input=discontinuity_3.Points)  # disabled
shift_paths = ShiftPaths(Data=average, Offset=-1)  # disabled
shift_paths_2 = ShiftPaths(Data=average_2, Offset=-1)  # disabled
shift_paths_3 = ShiftPaths(Data=average_3, Offset=-1)  # disabled
list_item_4 = ListItem(List=simplify(shift_paths), Index=graft(panel_4), Wrap=True)  # -> Item, Item1; disabled
list_item_5 = ListItem(List=simplify(shift_paths_2), Index=graft(panel_3), Wrap=True)  # -> Item, Item1; disabled
list_item_6 = ListItem(List=simplify(shift_paths_3), Index=graft(panel_5), Wrap=True)  # -> Item, Item1; disabled
number_slider_4 = Slider(352, range=0..1000)  # disabled
number_slider_5 = Slider(300, range=0..1000)  # disabled
number_slider_6 = Slider(99, range=0..1000)  # disabled
line = Line(StartPoint=list_item_4.Item, EndPoint=list_item_4.Item1)  # disabled
line_2 = Line(StartPoint=list_item_5.Item, EndPoint=list_item_5.Item1)  # disabled
line_3 = Line(StartPoint=list_item_6.Item, EndPoint=list_item_6.Item1)  # disabled
extend_curve = ExtendCurve(Curve=line, Type=0, Start=number_slider_4, End=number_slider_4)  # disabled
extend_curve_2 = ExtendCurve(Curve=line_2, Type=0, Start=number_slider_5, End=number_slider_5)  # disabled
extend_curve_3 = ExtendCurve(Curve=line_3, Type=0, Start=number_slider_6, End=number_slider_6)  # disabled
merge = Merge(Data1=extend_curve, Data2=extend_curve_2, Data3=extend_curve_3)  # disabled
bounding_box_2 = BoundingBox(Content=merge, Plane=PlaneXY(0, 0, 0), UnionBox=True)  # -> Box, Box_2; disabled

file_path = FilePath("C:\Users\libny\Macad\thesis-iaac\01_GH_SCRIPTS\test_vsc_gh.py")  # disabled
levels_picker = LevelsPicker(<levels picker referenced from the Revit model>)  # disabled
python_3_script = Python3Script(x=number_slider, y=number_slider_2, z=number_slider_3)  # -> vertex; disabled
# ---------- python_3_script: Python ----------
#r: topologicpy

import topologicpy as tp

if x == None:
    x = 0
if y == None:
    y = 0
if z == None:
    z = 0

vertex = tp.Vertex.Vertex.ByCoordinates
# ---------- end python_3_script ----------
query_walls_2 = QueryWalls(WallSystemFamily=wall_system_family)  # disabled
script = Script(Script=file_path, Y=y)  # -> Out, A, B, C; disabled
levels_picker_2 = LevelsPicker(<levels picker referenced from the Revit model>)  # disabled
query_walls_3 = QueryWalls(WallSystemFamily=wall_system_family_2)  # disabled
number_slider_7 = Slider(10, range=0..10)  # disabled
number_slider_8 = Slider(10, range=0..10)  # disabled
number_slider_9 = Slider(9, range=0..10)  # disabled
query_rooms = QueryRooms(Placed=True, Level=levels_picker)  # disabled
panel_6 = Panel(script.A)  # disabled
panel_7 = Panel(script.B)  # disabled
panel_8 = Panel(script.C)  # disabled
query_rooms_2 = QueryRooms(Placed=True, Level=levels_picker_2)  # disabled
panel_9 = Panel("bottom")  # disabled
analyze_wall_location_curve = AnalyzeWallLocationCurve(Wall=query_walls_2)  # -> LocationLine, CenterCurve, LocationCurve, OffsetValue; disabled
spatial_element_geometry = SpatialElementGeometry(SpatialElement=query_rooms, BoundaryLocation=0)  # -> Geometry, TopFaces, SideFaces, BottomFaces; disabled
analyze_wall_location_curve_2 = AnalyzeWallLocationCurve(Wall=query_walls_3)  # -> LocationLine, CenterCurve, LocationCurve, OffsetValue; disabled
python_3_script_2 = Python3Script(origin=python_3_script, width=number_slider_8, length=number_slider_7, height=number_slider_9, placement=panel_9)  # -> prism; disabled
# ---------- python_3_script_2: Python ----------
from topologicpy.Vertex import Vertex
from topologicpy.Cell import Cell

if origin == None:
    origin = Vertex.Origin()
if width == None:
    width = 1
if length == None:
    length = 1
if height == None:
    height = 1
if placement == None:
    placement = "center"

prism = Cell.Prism(origin=origin, width=width, length=length, height=height, placement=placement)
# ---------- end python_3_script_2 ----------
spatial_element_geometry_2 = SpatialElementGeometry(SpatialElement=query_rooms_2, BoundaryLocation=0)  # -> Geometry, TopFaces, SideFaces, BottomFaces; disabled
curve = Curve(analyze_wall_location_curve.CenterCurve)  # disabled
python_3_script_3 = Python3Script(topology=python_3_script_2)  # -> geometry; disabled
# ---------- python_3_script_3: Python ----------
from topologicpy.Topology import Topology
import Rhino.Geometry as rg

topology = Topology.Triangulate(topology)
d = Topology.Geometry(topology)

def create_mesh(vertices, edges, faces):
    mesh = rg.Mesh()

    for vertex in vertices:
        mesh.Vertices.Add(vertex)

    for face in faces:
        mesh.Faces.AddFace(face[0], face[1], face[2])

    mesh.UnifyNormals()
    return mesh

verts = d['vertices']
edges = d['edges']
faces = d['faces']

vertices = [rg.Point3d(v[0], v[1], v[2]) for v in verts]

geometry = create_mesh(vertices, edges, faces)
# ---------- end python_3_script_3 ----------
volume = Volume(Geometry=spatial_element_geometry.Geometry)  # -> Volume, Centroid; disabled
separation_lines = SeparationLines({"Rooms": -2000066, "Space": -2000831, "Areas": -2000079}, selected="Rooms")  # disabled
surface = Surface(flatten(spatial_element_geometry.BottomFaces))  # disabled
curve_2 = Curve(analyze_wall_location_curve_2.CenterCurve)  # disabled
volume_2 = Volume(Geometry=spatial_element_geometry_2.Geometry)  # -> Volume, Centroid; disabled
boundary_surfaces = BoundarySurfaces(Edges=curve)  # disabled
panel_10 = Panel(python_3_script_3)  # disabled
boundary_surfaces_2 = BoundarySurfaces(Edges=curve_2)  # disabled
category_filter_2 = CategoryFilter(Categories=separation_lines, Inverted=False)  # disabled
brep_edges = BrepEdges(Brep=boundary_surfaces)  # -> Naked, Interior, NonManifold; disabled
brep_edges_2 = BrepEdges(Brep=boundary_surfaces_2)  # -> Naked, Interior, NonManifold; disabled
query_elements_2 = QueryElements(Filter=category_filter_2, Limit=100)  # -> Elements, Count; disabled
join_curves = JoinCurves(Curves=brep_edges.Naked, Preserve=False)  # disabled
point_on_curve = PointOnCurve(curve, parameter=0.5)  # disabled
join_curves_2 = JoinCurves(Curves=brep_edges_2.Naked, Preserve=False)  # disabled
point_on_curve_2 = PointOnCurve(curve_2, parameter=0.5)  # disabled
curve_3 = Curve(query_elements_2.Elements)  # disabled
point_in_curve = PointInCurve(Point=point_on_curve, Curve=join_curves)  # -> Relationship, Point; disabled
discontinuity_4 = Discontinuity(Curve=join_curves_2, Level=1)  # -> Points, Parameters; disabled
separation_lines_2 = SeparationLines({"Rooms": -2000066, "Space": -2000831, "Areas": -2000079}, selected="Rooms")  # disabled
end_points = EndPoints(Curve=curve_3)  # -> Start, End; disabled
point_in_curve_2 = PointInCurve(Point=point_on_curve_2, Curve=join_curves_2)  # -> Relationship, Point; disabled
panel_11 = Panel("2")  # disabled
point = Point(graft([end_points.Start, end_points.End]))  # disabled
category_filter_3 = CategoryFilter(Categories=separation_lines_2, Inverted=False)  # disabled
equality = Equality(FirstNumber=point_in_curve.Relationship, SecondNumber=panel_11)  # -> Equality, Inequality; disabled
panel_12 = Panel("2")  # disabled
distance = Distance(PointA=point, PointB=discontinuity_4.Points)  # disabled
equality_2 = Equality(FirstNumber=point_in_curve_2.Relationship, SecondNumber=panel_12)  # -> Equality, Inequality; disabled
query_elements_3 = QueryElements(Filter=category_filter_3, Limit=100)  # -> Elements, Count; disabled
sort_list_2 = SortList(Keys=distance, ValuesA=discontinuity_4.Points)  # -> Keys, ValuesA; disabled
cull_pattern = CullPattern(List=curve, CullPattern=equality.Equality)  # disabled
cull_pattern_2 = CullPattern(List=curve_2, CullPattern=equality_2.Equality)  # disabled
list_item_7 = ListItem(List=sort_list_2.ValuesA, Index=0, Wrap=True)  # disabled
curve_4 = Curve(flatten([cull_pattern, query_elements_3.Elements]))  # disabled
polyline = PolyLine(Vertices=flatten(list_item_7), Closed=False)  # disabled
curve_5 = Curve(flatten([polyline, cull_pattern_2]))  # disabled
surface_split = SurfaceSplit(Surface=boundary_surfaces, Curves=flatten(cull_pattern))  # disabled
surface_split_2 = SurfaceSplit(Surface=boundary_surfaces_2, Curves=curve_5)  # disabled
number_slider_10 = Slider(3000, range=0..10000)  # disabled
number_slider_11 = Slider(3000, range=0..10000)  # disabled
unit_z = UnitZ(Factor=number_slider_10)  # disabled
unit_z_2 = UnitZ(Factor=number_slider_11)  # disabled
extrude = Extrude(Base=surface_split, Direction=unit_z)  # disabled
point_2 = Point(volume.Centroid)  # disabled
extrude_2 = Extrude(Base=surface_split_2, Direction=unit_z_2)  # disabled
boolean_toggle = BooleanToggle(True)  # disabled
point_3 = Point(volume_2.Centroid)  # disabled
boolean_toggle_2 = BooleanToggle(True)  # disabled
point_in_breps = PointInBreps(Brep=extrude, Point=point_2, Strict=boolean_toggle)  # -> Inside, Index; disabled
shape_in_brep = ShapeInBrep(Brep=bounding_box_2.Box, Shape=brep_2)  # disabled
point_in_breps_2 = PointInBreps(Brep=extrude_2, Point=point_3, Strict=boolean_toggle_2)  # -> Inside, Index; disabled
python_3_script_4 = Python3Script(rooms=extrude)  # -> out, a; inputs rooms: Brep; disabled; unedited script template
inside = Panel("0")  # disabled
equality_3 = Equality(FirstNumber=shape_in_brep, SecondNumber=inside)  # -> Equality, Inequality; disabled
number_slider_12 = Slider(4, range=0..10)  # disabled
list_item_8 = ListItem(List=extrude, Index=point_in_breps.Index, Wrap=True)  # disabled
list_item_9 = ListItem(List=extrude_2, Index=point_in_breps_2.Index, Wrap=True)  # disabled
aperture_bytopologycontext = ApertureByTopologyContext()  # disabled
cull_pattern_3 = CullPattern(List=brep_2, CullPattern=equality_3.Equality)  # disabled
brep_3 = Brep(list_item_9)  # disabled
list_item_10 = ListItem(List=list_item_8, Index=number_slider_12, Wrap=True)  # disabled
list_item_11 = ListItem(List=point_2, Index=number_slider_12, Wrap=True)  # disabled
topology_bygeometry_2 = TopologyByGeometry(Geometry=brep_3, Tolerance=0.0001)  # disabled
area_2 = Area(Geometry=cull_pattern_3)  # -> Area, Centroid; disabled
cellcomplex_bycells_2 = CellComplexByCells(Cells=topology_bygeometry_2)  # disabled
deconstruct = Deconstruct(Point=area_2.Centroid)  # -> XComponent, YComponent, ZComponent; disabled
graph_bytopology_2 = GraphByTopology(
    Topology=cellcomplex_bycells_2,
    Direct=True,
    ViaSharedTopologies=False,
    ViaSharedApertures=False,
    ToExteriorTopologies=False,
    ToExteriorApertures=False,
    UseFaceInternalVertex=False,
    Tolerance=0.0001)  # disabled
sort_list_3 = SortList(Keys=deconstruct.ZComponent, ValuesValuesA=cull_pattern_3)  # -> Keys, ValuesValuesA; disabled
list_item_12 = ListItem(List=sort_list_3.ValuesValuesA, Index=0, Wrap=True)  # -> Item1, Item; disabled
graph_vertices_2 = GraphVertices(Graph=graph_bytopology_2)  # disabled
top_door_surfaces = Surface(list_item_12.Item1)  # disabled
graph_edges_2 = GraphEdges(Graph=graph_bytopology_2, Vertices=graph_vertices_2, Tolerance=0.0001)  # disabled

edge_endvertex_2 = EdgeEndVertex(Edge=graph_edges_2)  # disabled
edge_startvertex_2 = EdgeStartVertex(Edge=graph_edges_2)  # disabled
topology_geometry_3 = TopologyGeometry(Topology=edge_endvertex_2, Tolerance=0.0001)  # disabled
topology_geometry_4 = TopologyGeometry(Topology=edge_startvertex_2, Tolerance=0.0001)  # disabled

ln_2 = Line(StartPoint=topology_geometry_4, EndPoint=topology_geometry_3)  # disabled
panel_13 = Panel("0.2")  # disabled
swatch_2 = ColourSwatch(SwatchColor=RGB(255, 0, 0))  # disabled
pipe_2 = Pipe(Curve=ln_2, Radius=panel_13, Caps=1)  # disabled

panel_14 = Panel("2800")  # disabled
unit_z_3 = UnitZ(Factor=panel_14)  # disabled
preview_2 = CustomPreview(Geometry=pipe_2, Material=swatch_2)  # disabled

levels_picker_3 = LevelsPicker(<levels picker referenced from the Revit model>)  # disabled
query_rooms_3 = QueryRooms(Placed=True, Level=levels_picker_3)  # disabled
level = Level(levels_picker_3)  # disabled
spatial_element_geometry_3 = SpatialElementGeometry(SpatialElement=query_rooms_3, BoundaryLocation=0)  # -> Geometry, TopFaces, SideFaces, BottomFaces; disabled

# ----
# Project rooms and door's top to the elevation of the chosen Revit level,
# so all rooms are in the same height (elevation).
panel_15 = Panel("Elevation")  # disabled
element_parameter = ElementParameter(Element=level, Parameter=panel_15)  # -> Element, Value; disabled
construct_point = ConstructPoint(XCoordinate=0, YCoordinate=0, ZCoordinate=element_parameter.Value)  # disabled
xy_plane = XYPlane(Origin=construct_point)  # disabled

project = Project(Geometry=spatial_element_geometry_3.BottomFaces, Plane=xy_plane)  # -> Geometry, Transform; disabled

project_2 = Project(Geometry=top_door_surfaces, Plane=xy_plane)  # -> Geometry, Transform; disabled
top_door_surfaces_2 = Surface(project_2.Geometry)  # disabled
rooms = Brep(project.Geometry)  # disabled
brep_4 = Brep(flatten([rooms, top_door_surfaces_2]))  # disabled
clean_tree = CleanTree(RemoveNulls=True, RemoveInvalid=True, RemoveEmpty=False, Tree=brep_4)  # disabled
extrude_3 = Extrude(Base=clean_tree, Direction=unit_z_3)  # disabled
brep_5 = Brep(extrude_3)  # disabled
topology_bygeometry_3 = TopologyByGeometry(Geometry=brep_5, Tolerance=0.0001)  # disabled
cellcomplex_byfaces = CellComplexByFaces(Faces=topology_bygeometry_3, Tolerance=0.001)
graph_bytopology_3 = GraphByTopology(
    Topology=cellcomplex_byfaces,
    Direct=True,
    ViaSharedTopologies=False,
    ViaSharedApertures=False,
    ToExteriorTopologies=False,
    ToExteriorApertures=False,
    UseFaceInternalVertex=False,
    Tolerance=0.0001)  # disabled
graph_vertices_3 = GraphVertices(Graph=graph_bytopology_3)  # disabled
graph_edges_3 = GraphEdges(Graph=graph_bytopology_3, Vertices=graph_vertices_3, Tolerance=0.0001)  # disabled

edge_endvertex_3 = EdgeEndVertex(Edge=graph_edges_3)  # disabled
edge_startvertex_3 = EdgeStartVertex(Edge=graph_edges_3)  # disabled
topology_geometry_5 = TopologyGeometry(Topology=edge_endvertex_3, Tolerance=0.0001)  # disabled
topology_geometry_6 = TopologyGeometry(Topology=edge_startvertex_3, Tolerance=0.0001)  # disabled

ln_3 = Line(StartPoint=topology_geometry_6, EndPoint=topology_geometry_5)  # disabled
panel_16 = Panel("0.2")  # disabled
swatch_3 = ColourSwatch(SwatchColor=RGB(255, 0, 0))  # disabled
pipe_3 = Pipe(Curve=ln_3, Radius=panel_16, Caps=1)  # disabled

preview_3 = CustomPreview(Geometry=pipe_3, Material=swatch_3)  # disabled
